# Grasshopper definition database_editing.gh (Grasshopper 1.0.7)
# plug-ins: LunchBox, ProvingGround.Slingshot, Telepathy

# BUILDING:
# =========
# seed
# lat
# long
# dimensions range
# quality range
# species
panel = Panel("4000 to 10000")

# ---- group: Testing : Clear Database
command = RDBFileCommand(
    ConnectToggle=Button(),
    SQLCommand="DELETE from items;",
    Connector="SQLite",
    Path="C:\Users\matt\Documents\iaac\studio_3\design_tool\database\material_database.s3db")
panel_2 = Panel(command)

# ----
# Density
# Fibre Stress at Elastic Limit
# Modulus of Elasticity (E)
# Compressive Strength Parallel to Grain
# (Shear Strength Parallel to Grain
path = FilePath("C:\Users\matt\Documents\iaac\studio_3\design_tool\database\wood_data.csv")
file = ReadFile(File=path, PerLineParse=True)
csv = ReadCSV(CSVString=file, Delimiter=",")  # -> Headers, Values
flip = FlipMatrix(Data=csv.Values)
split = SplitList(List=flip, Index="1")  # -> simplify(ListA), simplify(ListB)
txt_available_species = Text(flatten(split.ListA))
cset = CreateSet(List=flatten(split.ListA))  # -> Set, Map
txt_query = Text()
mindex = MemberIndex(Set=cset.Set, Member=txt_query)  # -> flatten(Index), Count
txt_available_species_2 = RemoteSender(txt_available_species)
branch = TreeBranch(Tree=split.ListB, Path=mindex.Index, MaintainPaths=False)
item = ListItem(List=simplify(branch), Index=0, Wrap=True)  # -> Item, Item1, Item2, Item3, Item4
num_strength_compressive = Number(flatten(item.Item3))
num_strength_shear = Number(flatten(item.Item4))
num_fiber_stress = Number(flatten(item.Item1))
num_density = Number(flatten(item.Item))
num_e = Number(flatten(item.Item2))
panel_3 = Panel("""kg/m3
MPa
GPa
MPa
MPa""")
num_strength_compressive_2 = RemoteSender(num_strength_compressive)
num_strength_shear_2 = RemoteSender(num_strength_shear)
num_fiber_stress_2 = RemoteSender(num_fiber_stress)
num_density_2 = RemoteSender(num_density)
num_e_2 = RemoteSender(num_e)

domain = Domain(panel)
domain_2 = Domain(Domain(50, 50))
domain_3 = Domain(Domain(25, 25))
domain_4 = Domain("100 to 6000")
domain_5 = Domain("100 to 100")
domain_6 = Domain("100 to 100")
domain_7 = Domain("1000 to 3000")
domain_8 = Domain("50 to 100")
domain_9 = Domain("50 to 100")
domain_10 = Domain("8000 to 10000")
domain_11 = Domain("50 to 50")
domain_12 = Domain("100 to 100")
domain_13 = Domain("500 to 4000")
domain_14 = Domain("50 to 100")
domain_15 = Domain("50 to 100")
cluster_generate_building = ClusterGenerateBuilding(
    num_site_lat="41.396",
    num_site_long="2.193",
    domain=domain,
    domain_3=domain_2,
    domain_2=domain_3,
    domain_quality="0.5 to 1",
    txt_possible_species="pine",
    int_item_count="200",
    int_seed="0")
cluster_generate_building_2 = ClusterGenerateBuilding(
    num_site_lat="41.254",
    num_site_long="1.902",
    domain=domain_4,
    domain_3=domain_5,
    domain_2=domain_6,
    domain_quality="0.25 to 0.75",
    txt_possible_species="cedar",
    int_item_count="200",
    int_seed="1")
cluster_generate_building_3 = ClusterGenerateBuilding(
    num_site_lat="41.62",
    num_site_long="0.62",
    domain=domain_7,
    domain_3=domain_8,
    domain_2=domain_9,
    domain_quality="0.4 to 0.6",
    txt_possible_species="oak",
    int_item_count="150",
    int_seed="2")
cluster_generate_building_4 = ClusterGenerateBuilding(
    num_site_lat="41.60",
    num_site_long="2.28",
    domain=domain_10,
    domain_3=domain_11,
    domain_2=domain_12,
    domain_quality="0.1 to 0.8",
    txt_possible_species="pine",
    int_item_count="250",
    int_seed="3")
cluster_generate_building_5 = ClusterGenerateBuilding(
    num_site_lat="41.98",
    num_site_long="2.82",
    domain=domain_13,
    domain_3=domain_14,
    domain_2=domain_15,
    domain_quality="0.8 to 1",
    txt_possible_species="cedar",
    int_item_count="200",
    int_seed="4")
panel_4 = Panel("granollers")
panel_5 = Panel("sitges")
panel_6 = Panel("lleida")
panel_7 = Panel("girona")
panel_8 = Panel("iaac")
merge = Merge(
    Data1=cluster_generate_building,
    Data2=cluster_generate_building_2,
    Data3=cluster_generate_building_3,
    Data4=cluster_generate_building_4,
    Data5=cluster_generate_building_5)

# ---- group: Add to Database
# If the param in the database  are modified remember to refresh the information with the button: Clear Database
# Makes the database update in one chunk > faster performance
panel_9 = Panel("""BEGIN TRANSACTION;
COMMIT;""")
txt_sql_commands = Text(flatten(merge))
ins = InsertItems(List=panel_9, Item=txt_sql_commands, Indices="1", Wrap=True)
command_2 = RDBFileCommand(
    ConnectToggle=Toggle(False),
    SQLCommand=ins,
    Connector="SQLite",
    Path="C:\Users\matt\Documents\iaac\studio_3\design_tool\database\material_database.s3db")
panel_10 = Panel(command_2)

# ----
viewer = ParamViewer(txt_sql_commands)

# ==== cluster ClusterGenerateBuilding

# ---- group: Random Seeds
how_many_random_components_to_control = Panel("6")
int_seed = ClusterInput()
int_seed_2 = Integer(int_seed)
random = Random(Range="0 to 100000", Number=how_many_random_components_to_control, Seed=int_seed_2)
item = ListItem(List=random, Index=0, Wrap="0")  # -> Item, Item1, Item2, Item3, Item4, Item5

# ----
int_item_count = ClusterInput()
txt_possible_species = ClusterInput()
domain_quality = ClusterInput()  # Domain : Quality
domain = ClusterInput()
domain_2 = ClusterInput()
domain_3 = ClusterInput()
txt_possible_species_2 = Text(txt_possible_species)
num_site_long = ClusterInput()  # Num : Site Long
int_item_count_2 = Integer(int_item_count)
num_site_lat = ClusterInput()  # Num : Site Lat
domain_4 = Domain(domain)
domain_5 = Domain(domain_2)
domain_6 = Domain(domain_quality)
domain_7 = Domain(domain_3)
repeat = RepeatData(Data=num_site_long, Length=int_item_count_2)
repeat_2 = RepeatData(Data=num_site_lat, Length=int_item_count_2)
lng = ListLength(List=txt_possible_species_2)
panel = Panel(domain_5)
random_2 = Random(Range=lng, Number=int_item_count_2, Seed=item.Item5)
panel_2 = Panel(domain_7)
panel_3 = Panel(domain_4)
int = Integer(random_2)
python_generate_uuid = GhPythonScript(n=int_item_count_2, seed=item.Item)  # -> out, output; inputs n: Int32
# ---------- python_generate_uuid: Python ----------
import rhinoscriptsyntax as rs

import random
import uuid

output = []

if seed is None:
    seed = 0
    
rd = random.Random()
rd.seed(seed)
for i in range(n):
    output.append(str(uuid.UUID(int=rd.getrandbits(128))))
# ---------- end python_generate_uuid ----------
random_3 = Random(Range=panel_3, Number=int_item_count_2, Seed=item.Item1)
random_4 = Random(Range=panel_2, Number=int_item_count_2, Seed=item.Item2)
random_5 = Random(Range=panel, Number=int_item_count_2, Seed=item.Item3)
random_6 = Random(Range=domain_6, Number=int_item_count_2, Seed=item.Item4)
item_2 = ListItem(List=txt_possible_species_2, Index=int, Wrap=True)
int_2 = Integer(random_3)
int_3 = Integer(random_4)
int_4 = Integer(random_5)
merge = Merge(
    Data1=simplify(graft(python_generate_uuid.output)),
    Data2=simplify(graft(int_2)),
    Data3=simplify(graft(int_3)),
    Data4=simplify(graft(int_4)),
    Data5=simplify(graft(random_6)),
    Data6=simplify(graft(item_2)),
    Data7=simplify(graft(repeat_2)),
    Data8=simplify(graft(repeat)))
sqlformatrows = SQLFormatRows(RowDataList=merge)  # -> flatten(RowStrings)
panel_4 = Panel("""uuid
x
y
z
quality
species
lat
lng""")
insert = SQLInsertCommand(Table="items", Columns=panel_4, Data=sqlformatrows, Update=False, Connector="MySQL")
txt_sql_commands = Text(insert)
txt_sql_commands_2 = ClusterOutput(txt_sql_commands)
