# Grasshopper definition design_tool.gh (Grasshopper 1.0.7)
# plug-ins: MeshEdit Components, Human UI, Fologram For Grasshopper Utilities, LunchBox, Weaverbird, MetaHopper, ProvingGround.Slingshot, Kangaroo2 Components, Telepathy, karambaGH

# ---- group: Required Plugins
# Instructions
# - Human UI (ui)
# - Lunchbox (csv loading)
# - Metahopper
# - Slingshot! (sql interaction)
# - Telepathy (wireless gh connections)
docinfo = DocumentInfo(AutoUpdate=False, Recursive=False)  # -> DocumentName, DocumentFilePath, Components, Params, _3rdPartyAssemblies
# White border components are UI controls
# Cyan border components may require reselecting a local filepath
panel = Panel(",")
split = TextSplit(Text=docinfo._3rdPartyAssemblies, Separators=panel)
item = ListItem(List=split, Index=0, Wrap=True)  # -> flatten(Item)
found_plugins = Panel(item)
txt = Text(["LunchBox", "ProvingGround.Slingshot", "HumanUI", "FologramForGrasshopperUtilites", "karambaGH", "Meshedit2000", "WeaverBird.Gh.CommonSdk", "ShortestWalk.Gh", "Telepathy"])
required_plugins = Panel(txt)

# ----
textbox = CreateTextBox(Label="Site Latitude", DefaultText="41.4", UpdateButton=True, showLabel=True)
textbox_2 = CreateTextBox(Label="Longitude", DefaultText="2.25", UpdateButton=True, showLabel=True)
merge = Merge(Data1=textbox, Data2=textbox_2)
stack = CreateStack(UIElements=merge, Horizontal=True)

minimal_quality = Slider(0, range=0..1)
slider = CreateSlider(Slider=minimal_quality, ShowBounds=False, ShowTicks=False, ShowTooltip=False, ShowValLabel=True, showLabel=True)

maximum_distance = Slider(200, range=0..200)
slider_2 = CreateSlider(Slider=maximum_distance, ShowBounds=False, ShowTicks=False, ShowTooltip=False, ShowValLabel=True, showLabel=True)

# ----
# Database GUI
panel_2 = Panel("oak")

# ---- group: Extracting Structural Informatoin by Species
# Density
# Fibre Stress at Elastic Limit
# Modulus of Elasticity (E)
# Compressive Strength Parallel to Grain
# (Shear Strength Parallel to Grain
path = FilePath("C:\Users\matt\Documents\iaac\studio_3\design_tool\database\wood_data.csv")
file = ReadFile(File=path, PerLineParse=True)
csv = ReadCSV(CSVString=file, Delimiter=",")  # -> Headers, Values
flip = FlipMatrix(Data=csv.Values)
split_2 = SplitList(List=flip, Index="1")  # -> simplify(ListA), simplify(ListB)
txt_available_species = Text(flatten(split_2.ListA))
cset = CreateSet(List=flatten(split_2.ListA))  # -> Set, Map
txt_query = Text(panel_2)
mindex = MemberIndex(Set=cset.Set, Member=txt_query)  # -> flatten(Index), Count
txt_available_species_2 = RemoteSender(txt_available_species)
branch = TreeBranch(Tree=split_2.ListB, Path=mindex.Index, MaintainPaths=False)
item_2 = ListItem(List=simplify(branch), Index=0, Wrap=True)  # -> Item, Item1, Item2, Item3, Item4
num_strength_compressive = Number(flatten(item_2.Item3))
num_strength_shear = Number(flatten(item_2.Item4))
num_fiber_stress = Number(flatten(item_2.Item1))
num_density = Number(flatten(item_2.Item))
num_e = Number(flatten(item_2.Item2))
panel_3 = Panel("""kg/m3
MPa
GPa
MPa
MPa""")
num_strength_compressive_2 = RemoteSender(num_strength_compressive)
num_strength_shear_2 = RemoteSender(num_strength_shear)
num_fiber_stress_2 = RemoteSender(num_fiber_stress)
num_density_2 = RemoteSender(num_density)
num_e_2 = RemoteSender(num_e)

# ----
label = CreateLabel(LabelText=" ", LabelSize=12, Justification=0)

separator = CreateSeparator(Thickness=0.5, Horizontal=True, Color=RGB(0, 0, 0))
swatch = ColourSwatch(SwatchColor=RGB(0, 83, 117))
swatch_2 = ColourSwatch(SwatchColor=RGB(2, 159, 224))

# ---- group: Batten Dimension
height = RemoteSender("50")
# Generative Design
width = RemoteSender("50")

# ---- group: level 0 / control lines distance
number_slider = Slider(2000, range=0..2000)
number_slider_2 = Slider(800, range=0..1000)

# ----
num = Number([845, -141, -172, -461, 228, -231, -790, 662, 995, -728])
num_2 = Number([-733, 678, 211, 533, -69, 666])
_200km = Panel(num)
_200km_2 = Panel(num_2)

genes = GenePool(Decimals=0, Maximum=1000, Minimum=-1000, Value=[845, -141, -172, -461, 228, -231, -790, 662, 995, -728])
path_mapper = PathMapper(_200km, source="{A}(i)", target="{i % 5}")
item_3 = ListItem(List=path_mapper, Index=0, Wrap=True)  # -> Item, Item1
vec = VectorXYZ(XComponent=item_3.Item, YComponent=0, ZComponent=item_3.Item1)  # -> flatten(Vector), Length
split_3 = SplitList(List=vec.Vector, Index="3")  # -> ListA, ListB

genes_2 = GenePool(Decimals=0, Maximum=1000, Minimum=-1000, Value=[-733, 678, 211, 533, -69, 666])
path_mapper_2 = PathMapper(_200km_2, source="{A}(i)", target="{i % 3}")
item_4 = ListItem(List=path_mapper_2, Index=0, Wrap=True)  # -> Item, Item1
vec_2 = VectorXYZ(XComponent=item_4.Item, YComponent=0, ZComponent=item_4.Item1)  # -> flatten(Vector), Length
crv = Curve(<curve referenced from the Rhino model>)
crv_2 = Curve(<curve referenced from the Rhino model>)
crv_3 = Curve(<curve referenced from the Rhino model>)
merge_2 = Merge(Data1=crv, Data2=crv_2, Data3=crv_3)
move = Move(Geometry=merge_2, Motion=vec_2.Vector)  # -> Geometry, Transform
item_5 = ListItem(List=move.Geometry, Index=0, Wrap=True)  # -> Item, Item1, Item2
crv_bottom_1 = RemoteSender(item_5.Item)
crv_bottom_2 = RemoteSender(item_5.Item1)
crv_bottom_3 = RemoteSender(item_5.Item2)

num_3 = Number([218, 4, 90, 354, -197, -111, -151, -695, -297, -542])
num_4 = Number([427, 288, 393, -4, -164, -314])
_100km = Panel(num_3)
_100km_2 = Panel(num_4)

num_5 = Number([123, 354, -48, -852, -698, 431, 606, 370, -780, 21])
num_6 = Number([-4, 226, 658, 127, 13, -200])
_50km = Panel(num_5)
_50km_2 = Panel(num_6)

# ---- group: Geometry Inputs
srf = Surface(<surface referenced from the Rhino model>)
crv_4 = Curve([<curve referenced from the Rhino model> x3])
crv_5 = Curve([<curve referenced from the Rhino model> x2])
move_2 = Move(Geometry=crv_4, Motion=split_3.ListA)  # -> Geometry, Transform
move_3 = Move(Geometry=crv_5, Motion=split_3.ListB)  # -> Geometry, Transform
crv_density_curves = RemoteSender(move_3.Geometry)
facade_surface = RemoteSender(srf)
crv_voids = RemoteSender(move_2.Geometry)

# ----
facade_surface_2 = RemoteReceiver(facade_surface)

# ---- group: transversal lines / mesh structure
facade_surface_3 = RemoteReceiver(facade_surface)
mplane = MeshPlane(Boundary=facade_surface_3, WidthCount=Slider(3, range=0..100), HeightCount=Slider(4, range=0..100))  # -> Mesh, Area
wbsplitquads = WeaverbirdsConstantQuadsSplitSubdivision(MeshCurves=mplane.Mesh, Level=Slider(2, range=0..10), SmoothNakedEdges="0")
explode = MeshExplode(Mesh=wbsplitquads, Interpolate=False)
demesh = DeconstructMesh(Mesh=explode)  # -> Vertices, Faces, Colours, Normals

# ----
crv_voids_2 = RemoteReceiver(crv_voids)
crv_bottom_3_2 = RemoteReceiver(crv_bottom_3)

number_slider_3 = Slider(-1600, range=-2000..0)
crv_density_curves_2 = RemoteReceiver(crv_density_curves)
facade_surface_4 = RemoteReceiver(facade_surface)
crv_voids_3 = RemoteReceiver(crv_voids)
crv_6 = Curve(<curve referenced from the Rhino model>)
crv_7 = Curve(crv_bottom_3_2)
cluster = Cluster(
    srf_facade=facade_surface_4,
    int_divisions_x=Slider(12, range=0..100),
    int_divisions_y=Slider(8, range=0..100),
    num_offset=number_slider_3,
    crv_attractor_curves=crv_density_curves_2,
    int_quad_split_iterations=Slider(2, range=0..10),
    num_split_distance=Slider(1000, range=0..2000),
    geom_voids=crv_voids_3,
    num_void_distance=Slider(600, range=0..1000),
    crv_control_upper=crv_6,
    crv_control_lower=crv_7,
    int_upper_division=Slider(40, range=0..100),
    int_lower_division=Slider(16, range=0..100))
d1 = RemoteSender(number_slider_3)

crv_bottom_2_2 = RemoteReceiver(crv_bottom_2)

number_slider_4 = Slider(-2000, range=-2000..0)
crv_density_curves_3 = RemoteReceiver(crv_density_curves)
facade_surface_5 = RemoteReceiver(facade_surface)
crv_voids_4 = RemoteReceiver(crv_voids)
crv_8 = Curve(<curve referenced from the Rhino model>)
crv_9 = Curve(crv_bottom_2_2)
cluster_2 = Cluster(
    srf_facade=facade_surface_5,
    int_divisions_x=Slider(12, range=0..100),
    int_divisions_y=Slider(8, range=0..100),
    num_offset=number_slider_4,
    crv_attractor_curves=crv_density_curves_3,
    int_quad_split_iterations=Slider(2, range=0..10),
    num_split_distance=Slider(4000, range=0..8000),
    geom_voids=crv_voids_4,
    num_void_distance=Slider(300, range=0..1000),
    crv_control_upper=crv_8,
    crv_control_lower=crv_9,
    int_upper_division=Slider(12, range=0..100),
    int_lower_division=Slider(10, range=0..100))
d2 = RemoteSender(number_slider_4)

crv_bottom_1_2 = RemoteReceiver(crv_bottom_1)

number_slider_5 = Slider(-2400, range=-4000..1)
crv_density_curves_4 = RemoteReceiver(crv_density_curves)
facade_surface_6 = RemoteReceiver(facade_surface)
crv_voids_5 = RemoteReceiver(crv_voids)
crv_10 = Curve(<curve referenced from the Rhino model>)
crv_11 = Curve(crv_bottom_1_2)
cluster_3 = Cluster(
    srf_facade=facade_surface_6,
    int_divisions_x=Slider(12, range=0..100),
    int_divisions_y=Slider(8, range=0..100),
    num_offset=number_slider_5,
    crv_attractor_curves=crv_density_curves_4,
    int_quad_split_iterations=Slider(1, range=0..10),
    num_split_distance=Slider(0, range=0..8000),
    geom_voids=crv_voids_5,
    num_void_distance=Slider(310, range=0..1000),
    crv_control_upper=crv_10,
    crv_control_lower=crv_11,
    int_upper_division=Slider(12, range=0..100),
    int_lower_division=Slider(10, range=0..100))
d3 = RemoteSender(number_slider_5)

midpt = CurveMiddle(Curve=cluster_2)
len = Length(Curve=cluster_2)
l2_points = RemoteSender(cluster_2)
frame = CurveFrame(Curve=cluster_2, Parameter=midpt)
frame_2 = CurveFrame(Curve=cluster_2, Parameter="0")
height_2 = RemoteReceiver(height)
width_2 = RemoteReceiver(width)
pl_origin = PlaneOrigin(Base=frame, Origin=midpt)
box = DomainBox(Base=frame_2, X=len, Y=width_2, Z=height_2)

# ---- group: transversal lines / transversal structure / P_02
pt = Point(demesh.Vertices)
l2_points_2 = RemoteReceiver(l2_points)
flatten = FlattenTree(Tree=pt, Path="{0}")
d2_2 = RemoteReceiver(d2)
pull = PullPoint(Point=flatten, Geometry=l2_points_2, ClosestOnly=True)  # -> ClosestPoint, Distance
smaller = SmallerThan(FirstNumber=pull.Distance, SecondNumber=expr("-x+0.001", d2_2))  # -> SmallerThan, OrEqualTo
dispatch = Dispatch(List=pull.ClosestPoint, DispatchPattern=smaller.OrEqualTo)  # -> ListA, ListB
pt_2 = Point(dispatch.ListA)

# ----
midpt_2 = CurveMiddle(Curve=cluster)
len_2 = Length(Curve=cluster)
l1_points = RemoteSender(cluster)
frame_3 = CurveFrame(Curve=cluster, Parameter=midpt_2)
frame_4 = CurveFrame(Curve=cluster, Parameter="0")
height_3 = RemoteReceiver(height)
width_3 = RemoteReceiver(width)
pl_origin_2 = PlaneOrigin(Base=frame_3, Origin=midpt_2)
box_2 = DomainBox(Base=frame_4, X=len_2, Y=width_3, Z=height_3)

# ---- group: transversal lines / transversal structure / P_01
pt_3 = Point(demesh.Vertices)
flatten_2 = FlattenTree(Tree=pt_3, Path="{0}")
l1_points_2 = RemoteReceiver(l1_points)
pull_2 = PullPoint(Point=flatten_2, Geometry=l1_points_2, ClosestOnly=True)  # -> ClosestPoint, Distance
d1_2 = RemoteReceiver(d1)
smaller_2 = SmallerThan(FirstNumber=pull_2.Distance, SecondNumber=expr("-(x)", d1_2))  # -> SmallerThan, OrEqualTo
dispatch_2 = Dispatch(List=pull_2.ClosestPoint, DispatchPattern=smaller_2.OrEqualTo)  # -> ListA, ListB
pt_4 = Point(dispatch_2.ListA)

# ----
l3_points = RemoteSender(cluster_3)
midpt_3 = CurveMiddle(Curve=cluster_3)
height_4 = RemoteReceiver(height)
width_4 = RemoteReceiver(width)
frame_5 = CurveFrame(Curve=cluster_3, Parameter="0")
len_3 = Length(Curve=cluster_3)
frame_6 = CurveFrame(Curve=cluster_3, Parameter=midpt_3)
pl_origin_3 = PlaneOrigin(Base=frame_6, Origin=midpt_3)
box_3 = DomainBox(Base=frame_5, X=len_3, Y=width_4, Z=height_4)

# ---- group: transversal lines / transversal structure / P_03
pt_5 = Point(demesh.Vertices)
l3_points_2 = RemoteReceiver(l3_points)
flatten_3 = FlattenTree(Tree=pt_5, Path="{0}")
pull_3 = PullPoint(Point=flatten_3, Geometry=l3_points_2, ClosestOnly=True)  # -> ClosestPoint, Distance
d3_2 = RemoteReceiver(d3)
smaller_3 = SmallerThan(FirstNumber=pull_3.Distance, SecondNumber=expr("-x+0.001", d3_2))  # -> SmallerThan, OrEqualTo
dispatch_3 = Dispatch(List=pull_3.ClosestPoint, DispatchPattern=smaller_3.OrEqualTo)  # -> ListA, ListB
pt_6 = Point(dispatch_3.ListA)

# ----
midpt_4 = CurveMiddle(Curve=cluster)
len_4 = Length(Curve=cluster)
frame_7 = CurveFrame(Curve=cluster, Parameter=midpt_4)
frame_8 = CurveFrame(Curve=cluster, Parameter="0")
height_5 = RemoteReceiver(height)
width_5 = RemoteReceiver(width)
pl_origin_4 = PlaneOrigin(Base=frame_7, Origin=midpt_4)
box_4 = DomainBox(Base=frame_8, X=len_4, Y=width_5, Z=height_5)

panel_4 = Panel("""753F00
FF8900
C26700
005375
029FE0""")
swatch_3 = ColourSwatch(SwatchColor=RGB(117, 63, 0))
T = StateGate(States=Toggle(False))  # -> True, False
panel_5 = Panel("""0.5
0.3
0.2
0.3
0.4""")
# Design visualization
toggle = BooleanToggle(True)
T_2 = StateGate(States=toggle)  # -> True, False

number_slider_6 = Slider(190, range=0..255)
pipeline = GeometryPipeline(
    GroupByLayer=False,
    GroupByType=False,
    IncludeHidden=True,
    IncludeLocked=True,
    LayerFilter="00_Facade*",
    NameFilter="*",
    SublayerFiltering=True,
    TypeFilter=1073741848)
rgb = ColourRGB(Alpha=255, Red=number_slider_6, Green=number_slider_6, Blue=number_slider_6)
preview = CustomPreview(Geometry=pipeline, Material=rgb)

swatch_4 = ColourSwatch(SwatchColor=RGB(255, 137, 0))
swatch_5 = ColourSwatch(SwatchColor=RGB(117, 63, 0))
swatch_6 = ColourSwatch(SwatchColor=RGB(194, 103, 0))
merge_3 = Merge(Data1=ColourSwatch(SwatchColor=RGB(0, 83, 117)), Data2=ColourSwatch(SwatchColor=RGB(2, 159, 224)), Data3="255,0,0")

# ---- group: Construct SQL Query and Get Data
panel_6 = Panel("""x BETWEEN {0} AND {1} AND 
y BETWEEN {2} AND {3} AND 
z BETWEEN {4} AND {5} AND
 quality > {6} 
GROUP BY uuid
HAVING distance < {7} """)
panel_7 = Panel("""*, (
      6371 * acos (
      cos ( radians({0}) )
      * cos( radians( lat ) )
      * cos( radians( lng ) - radians({1}) )
      + sin ( radians({0}) )
      * sin( radians( lat ) )
    )
) AS distance""")

# ----
toggle_2 = CreateToggle(Default=False, Label="Query Database")
label_2 = CreateLabel(LabelText=" ", LabelSize="20", Justification="2")
merge_4 = Merge(Data1=toggle_2, Data2=label_2)
stack_2 = CreateStack(UIElements=merge_4, Horizontal=True)

rangeslider = CreateRangeSlider(SliderRange="0 to 100", StartingRange="0 to 100")
label_3 = CreateLabel(LabelText="Width Range", LabelSize=12, Justification=0)
merge_5 = Merge(Data1=label_3, Data2=rangeslider)

rangeslider_2 = CreateRangeSlider(SliderRange="0 to 100", StartingRange="0 to 100")
label_4 = CreateLabel(LabelText="Height Range", LabelSize=12, Justification=0)
merge_6 = Merge(Data1=label_4, Data2=rangeslider_2)

rangeslider_3 = CreateRangeSlider(SliderRange="100 to 10000", StartingRange="100 to 10000")
label_5 = CreateLabel(LabelText="Length Range", LabelSize=12, Justification=0)
merge_7 = Merge(Data1=label_5, Data2=rangeslider_3)

merge_8 = Merge(
    Data1=merge_7,
    Data2=merge_5,
    Data3=merge_6,
    Data4=label,
    Data5=slider,
    Data6=slider_2,
    Data7=stack,
    Data8=separator,
    Data9=stack_2)

# ---- group: UI Core
panel_8 = Panel("Database Parameters")
toggle_3 = BooleanToggle(True)
data_elements = Data(merge_8)

# ----
launchxpwin = LaunchTransparentWindow(Show=toggle_3, Name=panel_8, Width=370, Height=400, ChildStatus=0, EnableHorizScroll=False)

# ---- group: UI Core (continued)
addelems = AddElements(Window=launchxpwin, Elements=flatten(data_elements), DoVLChecking=True)  # -> AddedElements, ElementNames
values = ValueListener(Elements=addelems.AddedElements, SomeProperty=True)  # -> Values, Indices
item_6 = ListItem(List=flatten(values.Values), Index=0, Wrap=True)  # -> Item, Item1, Item2, Item3, Item4, Item5, Item6, Item7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
num_maximum_distance = RemoteSender(item_6.Item8)
boolean_query_database = RemoteSender(item_6.Item12)
num_min_quality = RemoteSender(item_6.Item7)
domain_length = RemoteSender(item_6.Item1)
domain_height = RemoteSender(item_6.Item5)
num_site_long = RemoteSender(item_6.Item10)
domain_width = RemoteSender(item_6.Item3)
num_site_lat = RemoteSender(item_6.Item9)

# ----
domain_length_2 = RemoteReceiver(domain_length)
dedomain = DeconstructDomain(Domain=domain_length_2)  # -> Start, End
expression = Expression(x=dedomain.Start, Expression="round(x * 100) / 100")
expression_2 = Expression(x=dedomain.End, Expression="round(x * 100) / 100")
format = Format(Format="Length Range : ({0} : {1})", Culture=127, Data0=expression, Data1=expression_2)
setlabel = SetLabelContents(LabelToModify=label_5, NewLabelContents=format)

domain_height_2 = RemoteReceiver(domain_height)
dedomain_2 = DeconstructDomain(Domain=domain_height_2)  # -> Start, End
expression_3 = Expression(x=dedomain_2.Start, Expression="round(x * 100) / 100")
expression_4 = Expression(x=dedomain_2.End, Expression="round(x * 100) / 100")
format_2 = Format(Format="Height Range : ({0} : {1})", Culture=127, Data0=expression_3, Data1=expression_4)
setlabel_2 = SetLabelContents(LabelToModify=label_4, NewLabelContents=format_2)

domain_width_2 = RemoteReceiver(domain_width)
dedomain_3 = DeconstructDomain(Domain=domain_width_2)  # -> Start, End
expression_5 = Expression(x=dedomain_3.Start, Expression="round(x * 100) / 100")
expression_6 = Expression(x=dedomain_3.End, Expression="round(x * 100) / 100")
format_3 = Format(Format="Width Range : ({0} : {1})", Culture=127, Data0=expression_5, Data1=expression_6)
setlabel_3 = SetLabelContents(LabelToModify=label_3, NewLabelContents=format_3)

# ---- group: Construct SQL Query and Get Data (continued)
domain_length_3 = RemoteReceiver(domain_length)
domain_height_3 = RemoteReceiver(domain_height)
domain_width_3 = RemoteReceiver(domain_width)
num_maximum_distance_2 = RemoteReceiver(num_maximum_distance)
num_min_quality_2 = RemoteReceiver(num_min_quality)
dedomain_4 = DeconstructDomain(Domain=domain_length_3)  # -> Start, End
dedomain_5 = DeconstructDomain(Domain=domain_width_3)  # -> Start, End
dedomain_6 = DeconstructDomain(Domain=domain_height_3)  # -> Start, End
num_site_long_2 = RemoteReceiver(num_site_long)
num_site_lat_2 = RemoteReceiver(num_site_lat)
format_4 = Format(
    Format=panel_6,
    Culture=127,
    Data0=dedomain_4.Start,
    Data1=dedomain_4.End,
    Data2=dedomain_5.Start,
    Data3=dedomain_5.End,
    Data4=dedomain_6.Start,
    Data5=dedomain_6.End,
    Data6=num_min_quality_2,
    Data7=num_maximum_distance_2)
# Querying the Database
format_5 = Format(Format=panel_7, Culture=127, Data0=num_site_lat_2, Data1=num_site_long_2)
boolean_query_database_2 = RemoteReceiver(boolean_query_database)
querysfw = SQLSELECTString(Select=format_5, From="items", Where=format_4, Connector="MySQL")
query = RDBFileQuery(
    ConnectToggle=boolean_query_database_2,
    SQLQuery=querysfw,
    Database="SQLite",
    Path="C:\Users\matt\Documents\iaac\studio_3\design_tool\database\material_database.s3db")  # -> Exceptions, TableHeadings, TableData
flip_2 = FlipMatrix(Data=query.TableData)
tstat = TreeStatistics(Tree=flip_2)  # -> Paths, Length, Count
dam = DataDam(DataA=flip_2, BufferDelay=10000000, BufferMode=1)
python = GhPythonScript(n=tstat.Count)  # -> a
# ---------- python: Python ----------
__author__ = "matt"
__version__ = "2020.04.26"

import rhinoscriptsyntax as rs

if n == None:
    a = "0"
else:
    a = n
# ---------- end python ----------
num_db_item_count = RemoteSender(python)
item_7 = ListItem(List=simplify(dam), Index=0, Wrap=True)  # -> flatten(Item), flatten(Item1), flatten(Item2), flatten(Item3), flatten(Item4), flatten(Item5), flatten(Item6), flatten(Item7), flatten(Item8)
txt_2 = Text(item_7.Item5)
num_7 = Number(item_7.Item6)
num_8 = Number(item_7.Item7)
num_9 = Number(item_7.Item8)
txt_3 = Text(item_7.Item)
num_10 = Number(item_7.Item1)
num_11 = Number(item_7.Item2)
num_12 = Number(item_7.Item3)
num_13 = Number(item_7.Item4)
items_distance = RemoteSender(num_9)
items_species = RemoteSender(txt_2)
items_quality = RemoteSender(num_13)
items_uuids = RemoteSender(txt_3)
items_x = RemoteSender(num_10)
items_y = RemoteSender(num_11)
items_z = RemoteSender(num_12)

# ----
num_db_item_count_2 = RemoteReceiver(num_db_item_count)
format_6 = Format(Format="        Items : {0}", Culture=127, Data0=num_db_item_count_2)
setlabel_4 = SetLabelContents(LabelToModify=label_2, NewLabelContents=format_6)

cset_2 = CreateSet(List=items_distance)  # -> Set, Map
sort = SortList(Keys=cset_2.Set)  # -> Keys, ValuesA
panel_9 = Panel(sort.Keys)

items_quality_2 = RemoteReceiver(items_quality)
items_x_2 = RemoteReceiver(items_x)
remap = RemapNumbers(Value=items_quality_2, Source="0 to 1", Target="12000")  # -> Mapped, Clipped
remap_2 = RemapNumbers(Value=items_x_2, Source="100 to 10000", Target="12000")  # -> Mapped, Clipped
items_y_2 = RemoteReceiver(items_y)
items_x_3 = RemoteReceiver(items_x)
items_z_2 = RemoteReceiver(items_z)
pt_7 = ConstructPoint(
    XCoordinate=Slider(13785, range=-40..70000),
    YCoordinate=Slider(-17659, range=-180000..90001),
    ZCoordinate=Slider(0, range=0..10000))
vec_3 = VectorXYZ(XComponent=remap_2.Mapped, YComponent=remap.Mapped, ZComponent=0)  # -> Vector, Length
# Database Visualization
panel_10 = Panel("75")
box_5 = DomainBox(Base=pt_7, X=panel_10, Y=panel_10, Z=items_x_3)
items_distance_2 = RemoteReceiver(items_distance)
panel_11 = Panel("0 to 200")
bnd = Bounds(Numbers=items_distance_2)
move_4 = Move(Geometry=box_5, Motion=vec_3.Vector)  # -> Geometry, Transform
remap_3 = RemapNumbers(Value=items_distance_2, Source=bnd, Target=Domain(0, 1))  # -> Mapped, Clipped
dataset_geometry = RemoteSender(move_4.Geometry)
ln = Line(StartPoint="255,255,255", EndPoint="166,77,121")
eval = EvaluateCurve(Curve=reparameterize(ln), Parameter=remap_3.Mapped)  # -> Point, Tangent, Angle
pdecon = Deconstruct(Point=eval.Point)  # -> XComponent, YComponent, ZComponent
panel_12 = Panel("120,180,30")
rgb_2 = ColourRGB(Alpha=255, Red=pdecon.XComponent, Green=pdecon.YComponent, Blue=pdecon.ZComponent)

gradient = Gradient(LowerLimit=0, UpperLimit=1, Parameter=remap_3.Mapped, stops=[0: RGB(0, 83, 117), 1: RGB(2, 159, 224)])

panel_13 = Panel("""0.25
0.5
0.75""")
l2_points_3 = RemoteReceiver(l2_points)
l3_points_3 = RemoteReceiver(l3_points)
l1_points_3 = RemoteReceiver(l1_points)

# ---- group: Attempts to cull unsupported elements
panel_14 = Panel("int(x*10) / 10")  # disabled
panel_15 = Panel("1")  # disabled

# ---- group: level 0 / mesh
crv_density_curves_5 = RemoteReceiver(crv_density_curves)
number_slider_7 = Slider(-1200, range=-10000..0)
merge_9 = Merge(Data1=crv_density_curves_5)
mplane_2 = MeshPlane(Boundary=facade_surface_2, WidthCount=Slider(12, range=0..100), HeightCount=Slider(8, range=0..100))  # -> Mesh, Area
Y = UnitY(Factor=number_slider_7)
move_5 = Move(Geometry=merge_9, Motion=Y)  # -> Geometry, Transform

# ----
d0 = RemoteSender(number_slider_7)

# ---- group: level 0_cable structure / cable structure
explode_2 = MeshExplode(Mesh=mplane_2.Mesh, Interpolate=False)
demesh_2 = DeconstructMesh(Mesh=explode_2)  # -> Vertices, Faces, Colours, Normals
item_8 = ListItem(List=demesh_2.Vertices, Index=0, Wrap=True)  # -> Item, Item1, Item2, Item3
d0_2 = RemoteReceiver(d0)
ln_2 = Line(StartPoint=item_8.Item1, EndPoint=item_8.Item2)  # -> flatten(Line)
Y_2 = UnitY(Factor=d0_2)
move_6 = Move(Geometry=ln_2, Motion=Y_2)  # -> Geometry, Transform

# ----
crv_12 = Curve(reparameterize(move_6.Geometry))

vertical_points = RemoteSender(crv_12)
midpt_5 = CurveMiddle(Curve=crv_12)
len_5 = Length(Curve=crv_12)
frame_9 = CurveFrame(Curve=crv_12, Parameter=midpt_5)
frame_10 = CurveFrame(Curve=crv_12, Parameter="0")
pl_origin_5 = PlaneOrigin(Base=frame_9, Origin=midpt_5)
box_6 = DomainBox(Base=frame_10, X=len_5, Y="50", Z="50")

# ---- group: transversal lines / transversal structure / L0_L1
vertical_points_2 = RemoteReceiver(vertical_points)
d0_3 = RemoteReceiver(d0)
d1_3 = RemoteReceiver(d1)
pull_4 = PullPoint(Point=flatten(pt_4), Geometry=vertical_points_2, ClosestOnly=True)  # -> ClosestPoint, Distance
expression_7 = Expression(x=d1_3, y=d0_3, Expression="y-x")
ln_3 = Line(StartPoint=pull_4.ClosestPoint, EndPoint=pt_4)
smaller_4 = SmallerThan(FirstNumber=ln_3, SecondNumber=expression_7)  # -> SmallerThan, OrEqualTo
dispatch_4 = Dispatch(List=ln_3, DispatchPattern=smaller_4.OrEqualTo)  # -> ListA, ListB
geo = Geometry(dispatch_4.ListA)

# ---- group: transversal lines / transversal structure / L0_L2
vertical_points_3 = RemoteReceiver(vertical_points)
d2_3 = RemoteReceiver(d2)
d0_4 = RemoteReceiver(d0)
pull_5 = PullPoint(Point=flatten(pt_2), Geometry=vertical_points_3, ClosestOnly=True)  # -> ClosestPoint, Distance
expression_8 = Expression(x=d2_3, y=d0_4, Expression="(y-x)+0.001")
ln_4 = Line(StartPoint=pull_5.ClosestPoint, EndPoint=pt_2)
smaller_5 = SmallerThan(FirstNumber=ln_4, SecondNumber=expression_8)  # -> SmallerThan, OrEqualTo
dispatch_5 = Dispatch(List=ln_4, DispatchPattern=smaller_5.OrEqualTo)  # -> ListA, ListB
geo_2 = Geometry(dispatch_5.ListA)

# ----
vertical_points_4 = RemoteReceiver(vertical_points)
shatter = Shatter(Curve=reparameterize(vertical_points_4), Parameters=panel_13)  # -> flatten(Segments)

# ---- group: level 0
move_7 = Move(Geometry=mplane_2.Mesh, Motion=Y)  # -> Geometry, Transform
move_8 = Move(Geometry=crv_voids_2, Motion=Y)  # -> Geometry, Transform
height_6 = RemoteReceiver(height)
width_6 = RemoteReceiver(width)

# ---- group: level 0 / mesh (continued)
facen = FaceNormals(Mesh=move_7.Geometry)  # -> Centers, Normals
explode_3 = MeshExplode(Mesh=move_7.Geometry, Interpolate=False)
pull_6 = PullPoint(Point=facen.Centers, Geometry=move_5.Geometry, ClosestOnly=True)  # -> ClosestPoint, Distance

# ---- group: level 0 / grid subdivision
smaller_6 = SmallerThan(FirstNumber=pull_6.Distance, SecondNumber=number_slider_2)  # -> SmallerThan, OrEqualTo
larger = LargerThan(FirstNumber=pull_6.Distance, SecondNumber=number_slider)  # -> LargerThan, OrEqualTo
dispatch_6 = Dispatch(List=explode_3, DispatchPattern=smaller_6.SmallerThan)  # -> ListA, ListB
dispatch_7 = Dispatch(List=explode_3, DispatchPattern=larger.LargerThan)  # -> ListA, ListB
grid_1 = Mesh(dispatch_6.ListB)
wbsplitquads_2 = WeaverbirdsConstantQuadsSplitSubdivision(MeshCurves=grid_1, Level=Slider(2, range=0..10), SmoothNakedEdges="0")

# ---- group: level 0 / grid subdivision / grid 0
mesh = Mesh(dispatch_6.ListA)

# ---- group: level 0 / grid subdivision / grid 2
mesh_2 = Mesh(dispatch_7.ListA)

# ---- group: level 0 / grid subdivision (continued)
wbsplitquads_3 = WeaverbirdsConstantQuadsSplitSubdivision(MeshCurves=mesh_2, Level=Slider(3, range=0..10), SmoothNakedEdges="0")
merge_10 = Merge(Data1=mesh, Data2=wbsplitquads_2)

# ---- group: level 0 (continued)
mjoin = MeshJoin(Meshes=flatten(merge_10))

# ---- group: level 0 / create openings
facen_2 = FaceNormals(Mesh=mjoin)  # -> Centers, Normals
boundary = BoundarySurfaces(Edges=move_8.Geometry)
pull_7 = PullPoint(Point=facen_2.Centers, Geometry=boundary, ClosestOnly=True)  # -> ClosestPoint, Distance
smaller_7 = SmallerThan(FirstNumber=pull_7.Distance, SecondNumber=Slider(400, range=0..1000))  # -> SmallerThan, OrEqualTo
cullf = CullFaces(Mesh=mjoin, Pattern=smaller_7.SmallerThan)

# ---- group: level 0 / lines horizontal
explode_4 = MeshExplode(Mesh=mjoin, Interpolate=False)
demesh_3 = DeconstructMesh(Mesh=explode_4)  # -> simplify(Vertices), Faces, Colours, Normals
item_9 = ListItem(List=demesh_3.Vertices, Index=0, Wrap=True)  # -> Item, Item1, Item2, Item3
ln_5 = Line(StartPoint=item_9.Item, EndPoint=item_9.Item1)  # -> simplify(Line)

# ----
items_y_3 = RemoteReceiver(items_y)
items_z_3 = RemoteReceiver(items_z)

matselect = MaterialSelectionKaramba3D(menu=[dropdown(4), dropdown(1)])
loads = LoadsKaramba3D(Vector=Vector(0, 0, -1), LCase=0, mode="Gravity")

# ---- group: transversal lines / transversal structure / L0_L3
vertical_points_5 = RemoteReceiver(vertical_points)
d0_5 = RemoteReceiver(d0)
pull_8 = PullPoint(Point=flatten(pt_6), Geometry=vertical_points_5, ClosestOnly=True)  # -> ClosestPoint, Distance
ln_6 = Line(StartPoint=pull_8.ClosestPoint, EndPoint=pt_6)

# ---- group: transversal lines / transversal structure
d3_3 = RemoteReceiver(d3)

# ---- group: transversal lines / transversal structure / L0_L3 (continued)
expression_9 = Expression(x=d3_3, y=d0_5, Expression="(y-x)+0.001")
smaller_8 = SmallerThan(FirstNumber=ln_6, SecondNumber=expression_9)  # -> SmallerThan, OrEqualTo
dispatch_8 = Dispatch(List=ln_6, DispatchPattern=smaller_8.OrEqualTo)  # -> ListA, ListB
geo_3 = Geometry(dispatch_8.ListA)

# ---- group: transversal lines / transversal structure (continued)
merge_11 = Merge(Data1=geo, Data2=geo_2, Data3=geo_3)

# ----
end = EndPoints(Curve=merge_11)  # -> Start, End
pt_8 = Point(end.Start)
cset_3 = CreateSet(List=pt_8)  # -> Set, Map
mindex_2 = MemberIndex(Set=pt_8, Member=cset_3.Set)  # -> Index, Count
item_10 = ListItem(List=merge_11, Index=mindex_2.Index, Wrap=True)
len_6 = Length(Curve=item_10)
sort_2 = SortList(Keys=len_6, ValuesA=item_10)  # -> Keys, ValuesA
item_11 = ListItem(List=sort_2.ValuesA, Index=0, Wrap=True)  # -> Item1, Item
crv_13 = Curve(flatten(item_11.Item1))

# ---- group: transversal lines
dupln = RemoveDuplicateLines(Lines=crv_13, Tolerance=0.01)
line_support = RemoteSender(dupln)
midpt_6 = CurveMiddle(Curve=dupln)
len_7 = Length(Curve=dupln)
frame_11 = CurveFrame(Curve=dupln, Parameter=midpt_6)
height_7 = RemoteReceiver(height)
width_7 = RemoteReceiver(width)
frame_12 = CurveFrame(Curve=dupln, Parameter="0")
pl_origin_6 = PlaneOrigin(Base=frame_11, Origin=midpt_6)
box_7 = DomainBox(Base=frame_12, X=len_7, Y=width_7, Z=height_7)

# ----
line_support_2 = RemoteReceiver(line_support)
merge_12 = Merge(Data1=line_support_2, Data3=vertical_points_4, Data4=l1_points_3, Data5=l2_points_3, Data6=l3_points_3)
scale = Scale(Geometry=merge_12, Center=Point(0, 0, 0), Factor=".001")  # -> flatten(Geometry), Transform
crv_14 = Curve(scale.Geometry)
end_2 = EndPoints(Curve=crv_14)  # -> Start, End
ln_7 = Line(StartPoint=end_2.Start, EndPoint=end_2.End)
llinter = LineLineIntersectionKaramba3D(Line=ln_7, LimitDistance_m=".0501")  # -> IntersectionPoints, flatten(LineSubSegements)

merge_13 = Merge(Data1=line_support_2, Data3=vertical_points_4, Data4=l1_points_3, Data5=l2_points_3, Data6=l3_points_3)  # -> flatten(Result)
len_8 = Length(Curve=merge_13)
curve_trimmed_elements = RemoteSender(merge_13)
num_design_lengths = RemoteSender(len_8)

# ---- group: Attempts to cull unsupported elements (continued)
end_3 = EndPoints(Curve=llinter.LineSubSegements)  # -> Start, End; disabled
pdecon_2 = Deconstruct(Point=end_3.Start)  # -> XComponent, YComponent, ZComponent; disabled
pdecon_3 = Deconstruct(Point=end_3.End)  # -> XComponent, YComponent, ZComponent; disabled
eval_2 = Evaluate(F=panel_14, x=pdecon_2.XComponent)  # disabled
eval_3 = Evaluate(F=panel_14, x=pdecon_2.YComponent)  # disabled
eval_4 = Evaluate(F=panel_14, x=pdecon_2.ZComponent)  # disabled
eval_5 = Evaluate(F=panel_14, x=pdecon_3.XComponent)  # disabled
eval_6 = Evaluate(F=panel_14, x=pdecon_3.YComponent)  # disabled
eval_7 = Evaluate(F=panel_14, x=pdecon_3.ZComponent)  # disabled
pt_9 = ConstructPoint(XCoordinate=eval_2, YCoordinate=eval_3, ZCoordinate=eval_4)  # disabled
pt_10 = ConstructPoint(XCoordinate=eval_5, YCoordinate=eval_6, ZCoordinate=eval_7)  # disabled
merge_14 = Merge(Data1=pt_9, Data2=pt_10)  # disabled
mindex_3 = MemberIndex(Set=merge_14, Member=pt_9)  # -> Index, Count; disabled
mindex_4 = MemberIndex(Set=merge_14, Member=pt_10)  # -> Index, Count; disabled
larger_2 = LargerThan(FirstNumber=mindex_3.Count, SecondNumber=panel_15)  # -> LargerThan, OrEqualTo; disabled
larger_3 = LargerThan(FirstNumber=mindex_4.Count, SecondNumber=panel_15)  # -> LargerThan, OrEqualTo; disabled
and = GateAnd(A=larger_2.LargerThan, B=larger_3.LargerThan)  # disabled
dispatch_9 = Dispatch(List=llinter.LineSubSegements, DispatchPattern=and)  # -> ListA, ListB; disabled
crv_15 = Curve(dispatch_9.ListA)  # disabled

# ----
crv_16 = Curve(llinter.LineSubSegements)

# ---- group: Find Suport Points
end_4 = EndPoints(Curve=crv_16)  # -> Start, End
merge_15 = Merge(Data1=end_4.Start, Data2=end_4.End)  # -> flatten(Result)
pdecon_4 = Deconstruct(Point=merge_15)  # -> XComponent, YComponent, ZComponent
eval_8 = EvaluateCurve(Curve=reparameterize(crv_16), Parameter="0.5")  # -> Point, Tangent, Angle
bnd_2 = Bounds(Numbers=pdecon_4.ZComponent)
end_5 = EndPoints(Curve=crv_16)  # -> Start, End
pdecon_5 = Deconstruct(Point=eval_8.Point)  # -> XComponent, YComponent, ZComponent
dedomain_7 = DeconstructDomain(Domain=bnd_2)  # -> Start, End
bnd_3 = Bounds(Numbers=pdecon_5.YComponent)
similar = Similarity(FirstNumber=pdecon_4.ZComponent, SecondNumber=dedomain_7.End, Threshold=0.1)  # -> Similarity, AbsoluteDifference
similar_2 = Similarity(FirstNumber=pdecon_4.ZComponent, SecondNumber=dedomain_7.Start, Threshold=0.1)  # -> Similarity, AbsoluteDifference
merge_16 = Merge(Data1=graft(end_5.Start), Data2=graft(end_5.End))
dedomain_8 = DeconstructDomain(Domain=bnd_3)  # -> Start, End
flip_3 = FlipMatrix(Data=merge_16)
dispatch_10 = Dispatch(List=merge_15, DispatchPattern=similar.Similarity)  # -> ListA, ListB
dispatch_11 = Dispatch(List=merge_15, DispatchPattern=similar_2.Similarity)  # -> ListA, ListB
similar_3 = Similarity(FirstNumber=pdecon_5.YComponent, SecondNumber=dedomain_8.End, Threshold=0.1)  # -> Similarity, AbsoluteDifference
dispatch_12 = Dispatch(List=flip_3, DispatchPattern=similar_3.Similarity)  # -> ListA, ListB
merge_17 = Merge(Data1=flatten(dispatch_12.ListA), Data2=dispatch_10.ListA, Data3=dispatch_11.ListA)  # -> flatten(Result)

# ----
merge_18 = Merge(Data1=pl_origin_5, Data2=pl_origin_2, Data3=pl_origin, Data4=pl_origin_3, Data5=pl_origin_6)  # -> flatten(Result)
plane = RemoteSender(merge_18)

num_design_lengths_2 = RemoteReceiver(num_design_lengths)
number_slider_8 = Slider(5, range=0..100)
items_x_4 = RemoteReceiver(items_x)
plane_2 = RemoteReceiver(flatten(plane))
python_2 = GhPythonScript(design=num_design_lengths_2, database=items_x_4, planes=plane_2, tolerance=number_slider_8)  # -> out, cuts, output_lengths, output_planes, output_dbids, output_types, output_unmatched_count, output_ids; inputs design: list, database: list, planes: list of Plane
# ---------- python_2: Python ----------
# INPUTS
# design : dimensions of pieces described in design
# database : dimensions of pieces in database slice
# planes : center planes associated with design pieces
# tolerance : percentage a piece can be larger than design without needing to be cut


import rhinoscriptsyntax as rs
import ghpythonlib.components as gh

import bisect
import collections
import time

# === DECLARATIONS ===

output_lengths = []
output_planes = []
output_dbids = []
output_types = []


cuts = 0 # number of cuts

largest_db_value = 0

TYPE_FOUND = 0
TYPE_CUT = 1
TYPE_MISSING = 2

kerf_width = 3

# === DEFINITIONS ===

def millis():
    return int(round(time.time() * 1000))
    
def reverse_insort(a, x, concurrent_list = None, concurrent_item = None):
    """Insert item x in list a, and keep it reverse-sorted assuming a
    is reverse-sorted.

    If x is already in a, insert it to the right of the rightmost x.
    Doesn't use lo and hi arguments
    """
    lo = 0
    hi = len(a)
        
    while lo < hi:
        mid = (lo+hi)//2
        if x > a[mid]: 
            hi = mid
        else: 
            lo = mid+1
    a.insert(lo, x)
    if concurrent_list is not None:
        concurrent_list.insert(lo,concurrent_item)



# === MAIN SCRIPT ===

# Time at start of execution
time_start = millis()

# Sort the database elements by length, and reverse to put largest first
database_ids = gh.Series(0,1,len(database))
database,database_ids = gh.SortList(database,database_ids)
database.reverse()
database_ids.reverse()

# Start largest available element
largest_db_value = database[0]

# Sort the design elements by length, and reverse to put largest first
design_new = []
planes_new = []
for id,length in enumerate(design):
    if length > largest_db_value:
        design_new.append(length / 2)
        design_new.append(length / 2)
        ori_1 = gh.ConstructPoint(length / 4,0,0)
        ori_2 = gh.ConstructPoint(-length / 4,0,0)
        ori_1 = gh.Orient(ori_1,gh.XYPlane(gh.ConstructPoint(0,0,0)),planes[id])[0]
        ori_2 = gh.Orient(ori_2,gh.XYPlane(gh.ConstructPoint(0,0,0)),planes[id])[0]
        planes_new.append(gh.PlaneOrigin(planes[id],ori_1))
        planes_new.append(gh.PlaneOrigin(planes[id],ori_2))
    else:
        design_new.append(length)
        planes_new.append(planes[id])
design = design_new
planes = planes_new

design_ids = gh.Series(0,1,len(design))
design,design_ids = gh.SortList(design,design_ids)
planes = gh.ListItem(planes,design_ids,True)
design.reverse()
planes.reverse()
design_ids.reverse()





# Record time taken for sorting
time_sort = millis()
print("Sort time : %s" % (time_sort - time_start))



for design_id,design_length in enumerate(design):
    minimum_id = -1
    minimum = 10000000000
    minimum_id_to_cut = -1
    minimum_to_cut = 10000000000
    design_plus_tolerance = design_length + (design_length*(tolerance/100.))
    # If the item is bigger than the dataset, build of two parts
    if design_plus_tolerance > largest_db_value:
        new_length = design_length / 2
        #continue
    for item_id,item_length in enumerate(database):
        if item_length >= design_length:
            if item_length <= design_plus_tolerance:
                minimum = item_length
                minimum_id = item_id
            else:
                minimum_to_cut = item_length
                minimum_id_to_cut = item_id
        # If smaller, we're now below the usable range
        else:
           break

    # When it can't find any usable piece
    if minimum_id == -1 and minimum_id_to_cut == -1:
        output_lengths.append(design_length)
        output_types.append(TYPE_MISSING)
        output_dbids.append(-1)

    # When a cut happens
    elif minimum_id == -1:
        db_id = database_ids[minimum_id_to_cut]
        del database[minimum_id_to_cut]
        del database_ids[minimum_id_to_cut]
        
        output_lengths.append(design_length)
        output_types.append(TYPE_CUT)
        output_dbids.append(db_id)
        cutoff_length = minimum_to_cut - design_length - kerf_width
        reverse_insort(database,cutoff_length,database_ids,db_id)
        cuts = cuts + 1

    # When it finds a usable piece that doens't need cuts
    else:
        db_id = database_ids[minimum_id]
        del database[minimum_id]
        del database_ids[minimum_id]
        output_lengths.append(minimum)
        output_types.append(TYPE_FOUND)
        output_dbids.append(db_id)
        
    output_planes.append(planes[design_id])
    
time_end = millis()

output_unmatched_count = output_types.count(2)

print("Match time : %s" % (time_end - time_sort))

print("Fully Matched Items: %s" % output_types.count(0))
print("Matches After Cut: %s" % output_types.count(1))
print("Unmatched Items: %s" % output_unmatched_count)
print("Unused Database Items : %s" % len(database))
# ---------- end python_2 ----------
int_output_unmatched_count = RemoteSender(python_2.output_unmatched_count)
num_output_lengths = RemoteSender(python_2.output_lengths)
num_output_planes = RemoteSender(python_2.output_planes)
int_output_dbids = RemoteSender(python_2.output_dbids)
int_output_types = RemoteSender(python_2.output_types)
int_cut_count = RemoteSender(python_2.cuts)

int_output_dbids_2 = RemoteReceiver(int_output_dbids)
cset_4 = CreateSet(List=int_output_dbids_2)  # -> Set, Map
sort_3 = SortList(Keys=cset_4.Set)  # -> Keys, ValuesA
split_4 = SplitList(List=sort_3.Keys, Index="1")  # -> ListA, ListB
replace = ReplaceItems(List=gradient, Item=flatten(ColourSwatch(SwatchColor=RGB(120, 180, 30))), Indices=split_4.ListB, Wrap=False)
preview_2 = CustomPreview(Geometry=move_4.Geometry, Material=replace)

int_output_dbids_3 = RemoteReceiver(int_output_dbids)
int_output_dbids_4 = RemoteReceiver(int_output_dbids)
item_12 = ListItem(List=items_z_3, Index=int_output_dbids_4, Wrap=True)
item_13 = ListItem(List=items_y_3, Index=int_output_dbids_3, Wrap=True)
division = Division(A=item_13, B="10")
division_2 = Division(A=item_12, B="10")

cross_section = CrossSectionKaramba3D(
    FamilyNameOfCrossSection="DefaultCroSec",
    Material=matselect,
    Height_cm=division,
    UpperFlangeWidth_cm=division_2,
    LowerFlangeWidth_cm=division_2,
    mode="Trapezoid")
pt_11 = Point(merge_17)
supp = SupportKaramba3D(PosInd=pt_11, menu=[buttons(on, on, on, on, on, on)])
linetobeam = LineToBeamKaramba3D(Line=flatten(crv_16), CrossSection=cross_section, New=True, Remove=True, LimitDistance_m=0.005)  # -> Element, Points, Info
assemble = AssembleModelKaramba3D(Elem=flatten(linetobeam.Element), Support=flatten(supp), Load=flatten(loads), LimitDistance_m=0.005)  # -> Model, Info, Mass_kg, CenterOfGravity
analyze = AnalyzeKaramba3D(Model=assemble.Model)  # -> CalculatedModel, MaximumDisplacement_cm, ResultingForceOfGravity_kN, ElasticEnergy_kNm
modelview = ModelViewKaramba3D(Model=analyze.CalculatedModel, ResultFactors=1, ResultCase=-1)  # -> Model, DeformedMesh, DeformedAxes, DeformedModel
num_max_displacement = RemoteSender(analyze.MaximumDisplacement_cm)
beamview = BeamViewKaramba3D(Model=modelview.Model)  # -> Model, MeshesOfRenderedBeams, DeformedBeamAxes, LegendColors, LegendTags
legend = Legend(Colour=beamview.LegendColors, Tags=beamview.LegendTags, LegendType=1)

utilization = UtilizationOfElementsKaramba3D(
    AnalyzedModel=beamview.Model,
    ResultCase=-1,
    NumberOfSamplePoints=3,
    ElasticDesign=True,
    GammaM0=1,
    GammaM1=1,
    WithDetails=False,
    mode="Beams")  # -> AnalyzedModel, Utilization, SigMax_kN_cm2, SigMin_kN_cm2, TauMax_kN_cm2, UtilN, UtilVy, UtilVz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
beamdisp = BeamDisplacementsKaramba3D(AnalyzedModel=beamview.Model, LoadCase=-1, MaximumDistanceBetweenResults_m=-1, NumberOfResultsPerElement=2)  # -> AnalyzedModel, Translations_m, Rotations_rad
vlen = VectorLength(Vector=flatten(beamdisp.Translations_m))
bnd_4 = Bounds(Numbers=utilization.Utilization)
dedomain_9 = DeconstructDomain(Domain=bnd_4)  # -> Start, End
ma = MassAddition(Input=vlen)  # -> Result, PartialResults
num_total_displacement = RemoteSender(ma.Result)
panel_16 = Panel(ma.Result)
panel_17 = Panel(dedomain_9.End)
num_max_utilization = RemoteSender(dedomain_9.End)

bar_graph = BarGraph(num_design_lengths_2, BarColor=RGB(255, 0, 90))
bar_graph_2 = BarGraph(items_x_4, BarColor=RGB(255, 0, 90))
panel_18 = Panel(python_2.out)
bar_graph_3 = BarGraph(python_2.output_types, BarColor=RGB(255, 0, 90))
pie = PieChart(python_2.output_types)

# ----
# Optimization
int_output_unmatched_count_2 = RemoteReceiver(int_output_unmatched_count)
num_maximum_distance_3 = RemoteReceiver(num_maximum_distance)
num_total_displacement_2 = RemoteReceiver(num_total_displacement)
num_design_lengths_3 = RemoteReceiver(num_design_lengths)
num_max_utilization_2 = RemoteReceiver(num_max_utilization)
int_output_dbids_5 = RemoteReceiver(int_output_dbids)
items_distance_3 = RemoteReceiver(items_distance)
int_cut_count_2 = RemoteReceiver(int_cut_count)
item_14 = ListItem(List=items_distance_3, Index=int_output_dbids_5, Wrap="0")
lng = ListLength(List=num_design_lengths_3)
avr = Average(Input=item_14)
max_utilization = Panel(num_max_utilization_2)
total_displacement = Panel(num_total_displacement_2)
panel_19 = Panel(int_output_unmatched_count_2)
panel_20 = Panel(lng)
cuts = Panel(int_cut_count_2)
max_cuts = Panel(lng)
cost = Panel(avr)
max_cost = Panel(num_maximum_distance_3)
division_3 = Division(A=panel_19, B=panel_20)
division_4 = Division(A=cuts, B=max_cuts)
division_5 = Division(A=cost, B=max_cost)
num_14 = Number(max_utilization)
num_15 = Number(total_displacement)
panel_21 = Panel("""1
0.5
0.3
0.4
0.4""")
item_15 = ListItem(List=panel_21, Index=0, Wrap=True)  # -> Item, Item1, Item2, Item3, Item4
expression_10 = Expression(
    miss=division_3,
    cut=division_4,
    cost=division_5,
    util=num_14,
    disp=num_15,
    w1=item_15.Item,
    w2=item_15.Item1,
    w3=item_15.Item2,
    w4=item_15.Item3,
    w5=item_15.Item4,
    Expression="(w1*miss)+(w2*cut)+(w3*cost)+(w4*util)+(w5*disp)")
num_fitness = RemoteSender(expression_10)

num_fitness_2 = RemoteReceiver(num_fitness)
# Element Matching
galapagos = Galapagos(fitness=num_16, gene=[genes, genes_2])
num_16 = Number(num_fitness_2)
panel_22 = Panel(num_16)

panel_23 = Panel(expression_10)
panel_24 = Panel(division_3)
panel_25 = Panel(division_4)

# ---- group: Tracking Parameters
recg = DataRecorder(division_3, DataLimit=50, RecordData=True)
recg_2 = DataRecorder(division_4, DataLimit=50, RecordData=True)
recg_3 = DataRecorder(division_5, DataLimit=50, RecordData=True)
recg_4 = DataRecorder(num_14, DataLimit=50, RecordData=True)
recg_5 = DataRecorder(num_15, DataLimit=50, RecordData=True)
c_rec_ctrl = CSharpScript(clean=Button())  # -> out, pause_state; inputs clean: Boolean, pause: Boolean
# ---------- c_rec_ctrl: C# usings ----------
using System.IO;
using System.Linq;
using System.Data;
using System.Drawing;
using System.Reflection;
using System.Windows.Forms;
using System.Xml;
using System.Xml.Linq;
using System.Runtime.InteropServices;

using Rhino.DocObjects;
using Rhino.Collections;
using GH_IO;
using GH_IO.Serialization;
# ---------- c_rec_ctrl: C# ----------
    //iterate through all the objects of the grashopper document;
    foreach (object obj in GrasshopperDocument.Objects) {
      //check only for the GH_DataRecorder components
      if (obj is Grasshopper.Kernel.Special.GH_DataRecorder) {
        //cast the obj into GH_DataRecorder wrapper class to be able to access its methods
        Grasshopper.Kernel.Special.GH_DataRecorder dataDestroy = (Grasshopper.Kernel.Special.GH_DataRecorder) obj;

        if (dataDestroy.NickName == "RecG") {
          //store the recording state of the component in a temp boolean
          bool recState = dataDestroy.RecordData;

          if(clean) {
            //clean the data and reset the recorder component
            dataDestroy.DestroyRecordedData();
            dataDestroy.ExpireSolution(true);
          }
          if(pause) {
            dataDestroy.RecordData = !recState;
            recState = dataDestroy.RecordData;
          }
          pause_state = recState;
        }

      }
    }
# ---------- end c_rec_ctrl ----------
graph = QuickGraph(recg, SortOrder=0)
graph_2 = QuickGraph(recg_2, SortOrder=0)
graph_3 = QuickGraph(recg_3, SortOrder=0)
graph_4 = QuickGraph(recg_4, SortOrder=0)
graph_5 = QuickGraph(recg_5, SortOrder=0)

# ----
panel_26 = Panel(division_5)

int_output_dbids_6 = RemoteReceiver(int_output_dbids)
int_output_dbids_7 = RemoteReceiver(int_output_dbids)
items_y_4 = RemoteReceiver(items_y)
items_z_4 = RemoteReceiver(items_z)
item_16 = ListItem(List=items_z_4, Index=int_output_dbids_7, Wrap=True)
item_17 = ListItem(List=items_y_4, Index=int_output_dbids_6, Wrap=True)

num_output_lengths_2 = RemoteReceiver(num_output_lengths)
num_output_planes_2 = RemoteReceiver(num_output_planes)
width_8 = RemoteReceiver(width)
height_8 = RemoteReceiver(height)
int_output_types_2 = RemoteReceiver(int_output_types)
panel_27 = Panel("""0,255,0
255,255,0
255,0,0""")
division_6 = Division(A=item_17, B="2")
division_7 = Division(A=num_output_lengths_2, B="2")
division_8 = Division(A=item_16, B="2")
box_8 = CenterBox(Base=num_output_planes_2, X=division_7, Y=division_6, Z=division_8)
item_18 = ListItem(List=merge_3, Index=int_output_types_2, Wrap=True)
preview_3 = CustomPreview(Geometry=box_8, Material=item_18)

# ---- group: Matching Lines
dataset_geometry_2 = RemoteReceiver(dataset_geometry)
int_output_dbids_8 = RemoteReceiver(int_output_dbids)
edges = BrepEdges(Brep=box_8)  # -> Naked, Interior, NonManifold
box_9 = EvaluateBox(Box=dataset_geometry_2, UParameter=0.5, VParameter=0.5, WParameter="1")  # -> Plane, Point, Include
item_19 = ListItem(List=edges.Interior, Index=Slider(4, range=0..10), Wrap=True)
item_20 = ListItem(List=box_9.Point, Index=int_output_dbids_8, Wrap="0")
midpt_7 = CurveMiddle(Curve=item_19)  # -> flatten(Midpoint)
pt_12 = Point(item_20)
pt_13 = Point(midpt_7)
ln_8 = Line(StartPoint=pt_12, EndPoint=pt_13)
mpipe = MeshPipe(Polylines=ln_8, NumberOfSides=4, Tolerance=0.1, Radius="5", Cap="1", Join=False)
rgb_3 = ColourRGB(Alpha=Slider(164, range=0..255), Red="100", Green="100", Blue="100")
preview_4 = CustomPreview(Geometry=mpipe, Material=rgb_3)

# ----
brep = Brep(box_8)

# ---- group: level 0 (continued)
dupln_2 = RemoveDuplicateLines(Lines=ln_5, Tolerance=0.01)
join = JoinCurves(Curves=flatten(dupln_2), Preserve=False)

# ---- group: level 0 / Workaround for Overlapping Line Weirdness
disc = Discontinuity(Curve=join, Level=1)  # -> Points, Parameters
shatter_2 = Shatter(Curve=graft(join), Parameters=disc.Parameters)  # -> simplify(Segments)
len_9 = Length(Curve=shatter_2)
sort_4 = SortList(Keys=len_9, ValuesA=shatter_2)  # -> Keys, ValuesA
item_21 = ListItem(List=sort_4.ValuesA, Index=0, Wrap=True)  # -> flatten(Item), flatten(Item1)

# ----
crv_17 = Curve(reparameterize(item_21.Item1))
horizontal_points = RemoteSender(crv_17)
horizontal_points_2 = RemoteReceiver(horizontal_points)

# ---- group: level 0 (continued)
midpt_8 = CurveMiddle(Curve=crv_17)
len_10 = Length(Curve=crv_17)
frame_13 = CurveFrame(Curve=crv_17, Parameter="0")
frame_14 = CurveFrame(Curve=crv_17, Parameter="0.5")
pl_origin_7 = PlaneOrigin(Base=frame_14, Origin=midpt_8)
box_10 = DomainBox(Base=frame_13, X=len_10, Y="25", Z="25")

# ----
swatch_7 = ColourSwatch(SwatchColor=RGBA(0, 0, 0, 185))  # disabled
X = UnitX(Factor=1)  # disabled
swatch_8 = ColourSwatch(SwatchColor=RGB(255, 137, 0))  # disabled
swatch_9 = ColourSwatch(SwatchColor=RGB(117, 63, 0))  # disabled
swatch_10 = ColourSwatch(SwatchColor=RGB(194, 103, 0))  # disabled
move_9 = Move(Geometry=box_7, Motion=expr("x*2", X))  # -> Geometry, Transform; disabled
swatch_11 = ColourSwatch(SwatchColor=RGB(117, 63, 0))  # disabled
preview_5 = CustomPreview(Geometry=box_6, Material=swatch_7)  # disabled
preview_6 = CustomPreview(Geometry=box_10, Material=swatch_7)  # disabled
preview_7 = CustomPreview(Geometry=box, Material=swatch_10)  # disabled
preview_8 = CustomPreview(Geometry=box_3, Material=swatch_8)  # disabled
preview_9 = CustomPreview(Geometry=box_2, Material=swatch_9)  # disabled
preview_10 = CustomPreview(Geometry=move_9.Geometry, Material=swatch_11)  # disabled

# ==== cluster Cluster
int_quad_split_iterations = ClusterInput()  # Int : Quad Split Iterations
crv_attractor_curves = ClusterInput()  # Crv : Attractor Curves
num_void_distance = ClusterInput()  # Num : Void Distance
num_split_distance = ClusterInput()  # Num : Split Distance
int_divisions_x = ClusterInput()  # Int : Divisions X
int_divisions_y = ClusterInput()  # Int : Divisions Y
geom_voids = ClusterInput()  # Geom : Voids
num_offset = ClusterInput()  # Num : Offset
srf_facade = ClusterInput()  # Srf : Facade
mplane = MeshPlane(Boundary=srf_facade, WidthCount=int_divisions_x, HeightCount=int_divisions_y)  # -> Mesh, Area
merge = Merge(Data1=crv_attractor_curves)
Y = UnitY(Factor=num_offset)
move = Move(Geometry=mplane.Mesh, Motion=Y)  # -> Geometry, Transform
facen = FaceNormals(Mesh=move.Geometry)  # -> Centers, Normals
move_2 = Move(Geometry=merge, Motion=Y)  # -> Geometry, Transform
explode = MeshExplode(Mesh=move.Geometry, Interpolate=False)
pull = PullPoint(Point=facen.Centers, Geometry=move_2.Geometry, ClosestOnly=True)  # -> ClosestPoint, Distance
smaller = SmallerThan(FirstNumber=pull.Distance, SecondNumber=num_split_distance)  # -> SmallerThan, OrEqualTo
move_3 = Move(Geometry=geom_voids, Motion=Y)  # -> Geometry, Transform
dispatch = Dispatch(List=explode, DispatchPattern=smaller.SmallerThan)  # -> ListA, ListB
grid_1 = Mesh(dispatch.ListB)
mesh = Mesh(dispatch.ListA)
wbsplitquads = WeaverbirdsConstantQuadsSplitSubdivision(MeshCurves=grid_1, Level=int_quad_split_iterations, SmoothNakedEdges="0")
merge_2 = Merge(Data1=mesh, Data2=wbsplitquads)
mjoin = MeshJoin(Meshes=flatten(merge_2))
facen_2 = FaceNormals(Mesh=mjoin)  # -> Centers, Normals
boundary = BoundarySurfaces(Edges=move_3.Geometry)
pull_2 = PullPoint(Point=facen_2.Centers, Geometry=boundary, ClosestOnly=True)  # -> ClosestPoint, Distance
smaller_2 = SmallerThan(FirstNumber=pull_2.Distance, SecondNumber=num_void_distance)  # -> SmallerThan, OrEqualTo
cullf = CullFaces(Mesh=mjoin, Pattern=smaller_2.SmallerThan)
explode_2 = MeshExplode(Mesh=cullf, Interpolate=False)
demesh = DeconstructMesh(Mesh=explode_2)  # -> Vertices, Faces, Colours, Normals
item = ListItem(List=demesh.Vertices, Index=0, Wrap=True)  # -> Item, Item1, Item2, Item3
wbedges = WeaverbirdsMeshEdges(MeshOrPolylines=cullf)
ln = Line(StartPoint=item.Item, EndPoint=item.Item2)
ln_2 = Line(StartPoint=item.Item1, EndPoint=item.Item3)
merge_3 = Merge(Data1=ln, Data2=ln_2, Data3=wbedges)  # -> flatten(Result)
crv_control_upper = ClusterInput()  # Crv : Control Upper
int_upper_division = ClusterInput()  # Int : Upper Division
crv_control_lower = ClusterInput()  # Crv : Control Lower
int_lower_division = ClusterInput()  # Int : Lower Division

# ---- group: control lines
divide = DivideCurve(Curve=crv_control_upper, Count=int_upper_division, Kinks=False)  # -> Points, Tangents, Parameters
divide_2 = DivideCurve(Curve=crv_control_lower, Count=int_lower_division, Kinks=False)  # -> Points, Tangents, Parameters
pull_3 = PullPoint(Point=divide.Points, Geometry=divide_2.Points, ClosestOnly=True)  # -> ClosestPoint, Distance
ln_3 = Line(StartPoint=divide.Points, EndPoint=pull_3.ClosestPoint)

# ----
shortwalk = ShortestWalk(Curves=merge_3, WantedPath=ln_3)  # -> ShortestWalk, Succession, Direction, Length
explode_3 = Explode(Curve=shortwalk.ShortestWalk, Recursive=True)  # -> Segments, Vertices
cluster_join_curves = ClusterJoinCurves(crv=explode_3.Segments)
crv = Curve(cluster_join_curves)
crv_2 = ClusterOutput(crv)

# ==== cluster ClusterJoinCurves
crv = ClusterInput()

# ---- group: Join curves that follow the same angles
crv_2 = Curve(flatten(crv))
end = EndPoints(Curve=crv_2)  # -> Start, End
vec2pt = Vector2Pt(PointA=end.Start, PointB=end.End, Unitize="1")  # -> Vector, Length
multiplication = Multiplication(A=vec2pt.Vector, B="10")
devec = DeconstructVector(Vector=multiplication)  # -> XComponent, YComponent, ZComponent
int = Integer(devec.XComponent)
int_2 = Integer(devec.YComponent)
int_3 = Integer(devec.ZComponent)
vec = VectorXYZ(XComponent=int, YComponent=int_2, ZComponent=int_3)  # -> Vector, Length
python = GhPythonScript(vectors=vec.Vector)  # -> out, output; inputs vectors: list
# ---------- python: Python ----------
__author__ = "matt"
__version__ = "2020.06.18"

import rhinoscriptsyntax as rs
import ghpythonlib.components as gh

output = []



for v in vectors:
    
    parts = gh.DeconstructVector(v)
    
    parts = [0 if n ==0 else (n / abs(n)) for n in parts]
    
    part_sum = sum(parts)
    
    if parts[2] != 0:
        if parts[2] == -1:
            output.append(gh.Reverse(v))
        else:
            output.append(v)
    elif parts[1] != 0:
        if parts[1] == -1:
            output.append(gh.Reverse(v))
        else:
            output.append(v)
            
    elif parts[0] != 0:
        if parts[0] == -1:
            output.append(gh.Reverse(v))
        else:
            output.append(v)
# ---------- end python ----------
cset = CreateSet(List=python.output)  # -> Set, Map
mindex = MemberIndex(Set=python.output, Member=cset.Set)  # -> Index, Count
item = ListItem(List=crv_2, Index=mindex.Index, Wrap=True)
vdis = VectorDisplay(Anchor="0,0,0", Vector=cset.Set)

# ----
dupln = RemoveDuplicateLines(Lines=item, Tolerance=0.01)

# ---- group: Join curves that follow the same angles (continued)
join = JoinCurves(Curves=simplify(dupln), Preserve=False)
crv_3 = Curve(reparameterize(flatten(join)))

# ---- group: Callout and Preview Individual Orientations
crv_4 = Curve(join)  # disabled
number_slider = Slider(0, range=0..8)  # disabled
simplify = SimplifyCurve(Curve=crv_4)  # -> Curve, Simplified; disabled
panel = Panel("9")  # disabled
panel_2 = Panel("1")  # disabled
division = Division(A=number_slider, B=panel)  # disabled
tstat = TreeStatistics(Tree=simplify.Curve)  # -> Paths, Length, Count; disabled
addition = Addition(A=tstat.Count, B=panel_2)  # disabled
branch = TreeBranch(Tree=simplify(simplify.Curve), Path=number_slider, MaintainPaths=True)  # disabled
range = Range(Domain=Domain(0, 1), Steps=tstat.Count)  # disabled
panel_3 = Panel("-1")  # disabled
panel_4 = Panel("0.1")  # disabled
panel_5 = Panel("1")  # disabled
split = SplitList(List=range, Index=tstat.Count)  # -> ListA, ListB; disabled
mpipe = MeshPipe(Polylines=branch, NumberOfSides=4, Tolerance=0.1, Radius=panel_4, Cap=False, Join=False)  # disabled
hsv = ColourHSV(Alpha=panel_5, Hue=division, Saturation=panel_5, Value=panel_5)  # disabled
preview = CustomPreview(Geometry=simplify(mpipe), Material=simplify(graft(hsv)))  # disabled

# ----
crv_5 = ClusterOutput(crv_3)
