# Grasshopper definition moebius_design.gh (Grasshopper 1.0.7)
# plug-ins: Heteroptera, MeshEdit Components, Human UI, Pufferfish, Firefly.X, Anemone, Human, Parakeet, Fologram For Grasshopper Utilities, V-Ray For Grasshopper 6, Moonlight, LunchBox, Weaverbird, MetaHopper, ProvingGround.Slingshot, Starling, Kangaroo2 Components, Mesh Pipe, Wombat, Sunflower, TT Toolbox, Shortest Walk in Gh, Telepathy, karambaGH, Owl.GH

# ---- group: Required Plugins
# Instructions
# - Human UI (ui)
# - Lunchbox (csv loading)
# - Metahopper
# - Slingshot! (sql interaction)
# - Telepathy (wireless gh connections)
docinfo = DocumentInfo(AutoUpdate=False, Recursive=False)  # -> DocumentName, DocumentFilePath, Components, Params, _3rdPartyAssemblies
# White border components are UI controls
# Cyan border components may require reselecting a local filepath
panel = Panel(",")
split = TextSplit(Text=docinfo._3rdPartyAssemblies, Separators=panel)
item = ListItem(List=split, Index=0, Wrap=True)  # -> flatten(Item)
found_plugins = Panel(item)

# ----
moonlight = Moonlight(Mode=invert(False))

# ---- group: Connect these to the seed input for each Random component in the database generator
master_seed_change_this_to_generated_dif = Panel("0")  # "Master Seed (Change this to generated different databases"
how_many_random_components_to_control = Panel("7")
random = Random(Range="0 to 100000", Number=how_many_random_components_to_control, Seed=master_seed_change_this_to_generated_dif)
item_2 = ListItem(List=random, Index=0, Wrap=True)  # -> Item, Item1, Item2, Item3, Item4, Item5, Item6

# ----
maximum_distance = Slider(0, range=0..100)
slider = CreateSlider(Slider=maximum_distance, ShowBounds=False, ShowTicks=False, ShowTooltip=False, ShowValLabel=True, showLabel=True)

minimal_quality = Slider(0.31, range=0..1)
slider_2 = CreateSlider(Slider=minimal_quality, ShowBounds=False, ShowTicks=False, ShowTooltip=False, ShowValLabel=True, showLabel=True)

# ---- group: Testing : Clear Database
command = RDBFileCommand(
    ConnectToggle=Button(),
    SQLCommand="DELETE from items;",
    Connector="SQLite",
    Path="D:\Roberto\01 Projects\02 IAAC\02 Curso\Software III\Week 4\Database_ui\material_database.s3db")
panel_2 = Panel(command)

# ----
label = CreateLabel(LabelText=" ", LabelSize=12, Justification=0)

vec = VectorXYZ(XComponent=Slider(-36, range=-50..10), YComponent=Slider(20, range=-50..20), ZComponent=0)  # -> Vector, Length
num = Number("-1")

klein_surface = KleinSurface(UDivision=100, Radius1=Slider(5, range=0..10), Radius2=Slider(5, range=0..10))  # -> KleinSurface, KleinSurfacePoints, KleinSurfaceMesh
Z = UnitZ(Factor=Slider(1.2, range=0..2))
move = Move(Geometry=klein_surface.KleinSurface, Motion=Z)  # -> Geometry, Transform
rotate = Rotate(Geometry=move.Geometry, Angle=degrees(Slider(0, range=0..1000)), Plane=PlaneXY(0, 0, 0))  # -> Geometry, Transform

# ---- group: Batten Dimension
# Generative Design
width = RemoteSender("0.05")
height = RemoteSender("0.05")

# ---- group: level 1 / control lines distance
number_slider = Slider(2, range=0..2)

# ---- group: level 2 / control lines distance
number_slider_2 = Slider(1, range=0..1)

# ---- group: level 0 / control lines distance
number_slider_3 = Slider(2, range=0..2)
number_slider_4 = Slider(8, range=0..8)

# ---- group: control lines distance
number_slider_5 = Slider(0, range=0..10)

# ----
multiplication = Multiplication(A=Slider(3, range=0..10), B=Slider(1.2, range=0..10))
scale_nu = ScaleNU(Geometry=rotate.Geometry, Plane=PlaneXY(0, 0, 0), ScaleX=multiplication, ScaleY=multiplication, ScaleZ=multiplication)  # -> Geometry, Transform
quads = QuadPanels(Surface=scale_nu.Geometry, UDivisions=Slider(89, range=0..100), VDivisions=Slider(18, range=0..100))
slstarmesh = SlStarMesh(Polyline=quads)
facen = FaceNormals(Mesh=slstarmesh)  # -> Centers, Normals
avr = Average(Input=facen.Centers)  # -> flatten(ArithmeticMean)
avr_2 = Average(Input=facen.Normals)  # -> flatten(ArithmeticMean)
area = MeshArea(Mesh=slstarmesh)  # -> Area, Centroid
featurets = FeatureTensorSet(Feature0=avr_2, Feature1=area.Area)
kmeans = KMeansClustering(Data=featurets, Clusters=Slider(2, range=0..10), Iterations=Slider(8, range=0..1000), Seed=123)  # -> Clusters, Indices
item_3 = ListItem(List=kmeans.Clusters, Index=0, Wrap=True)  # -> Item, Item1, Item2
detset = DeconstructTensorSet(TensorSet=item_3.Item)
detset_2 = DeconstructTensorSet(TensorSet=item_3.Item1)
detensor = DeconstructTensor(Tensor=detset)
detensor_2 = DeconstructTensor(Tensor=detset_2)
item_4 = ListItem(List=detensor, Index=0, Wrap=True)  # -> flatten(Item), flatten(Item1), flatten(Item2)
item_5 = ListItem(List=detensor_2, Index=0, Wrap=True)  # -> flatten(Item), flatten(Item1), flatten(Item2)
vec_2 = VectorXYZ(XComponent=item_5.Item, YComponent=item_5.Item1, ZComponent=item_5.Item2)  # -> Vector, Length
vec_3 = VectorXYZ(XComponent=item_4.Item, YComponent=item_4.Item1, ZComponent=item_4.Item2)  # -> Vector, Length
mindex = MemberIndex(Set=avr_2, Member=vec_2.Vector)  # -> flatten(Index), Count
mindex_2 = MemberIndex(Set=avr_2, Member=vec_3.Vector)  # -> flatten(Index), Count
item_6 = ListItem(List=slstarmesh, Index=mindex_2.Index, Wrap=True)
item_7 = ListItem(List=slstarmesh, Index=mindex.Index, Wrap=True)
mesh_to_quad_faces = MeshToQuadFaces(M=item_7)
cluster = Cluster_3(L=mesh_to_quad_faces, L_2=mesh_to_quad_faces, M=mesh_to_quad_faces)

# ---- group: Panels for louvres
series = Series(Start=0, Step=1, Count=Slider(10, range=0..100))
cir = Circle(Plane=PlaneXY(0, 0, 0), Radius=Slider(24, range=0..100))
Z_2 = UnitZ(Factor=series)
move_2 = Move(Geometry=cir, Motion=Z_2)  # -> Geometry, Transform
divide = DivideCurve(Curve=move_2.Geometry, Count=Slider(100, range=0..100), Kinks=False)  # -> flatten(Points), Tangents, Parameters
cp = ClosestPoint(Point=avr, Cloud=divide.Points)  # -> ClosestPoint, CPIndex, Distance
sort = SortList(Keys=cp.Distance, ValuesA=avr)  # -> Keys, ValuesA
split_2 = SplitList(List=sort.ValuesA, Index=Slider(400, range=0..1000))  # -> ListA, ListB
pt = Point(split_2.ListA)
mindex_3 = MemberIndex(Set=avr, Member=pt)  # -> flatten(Index), Count
item_8 = ListItem(List=slstarmesh, Index=mindex_3.Index, Wrap=True)

# ---- group: Ramp
multiplication_2 = Multiplication(A=Slider(2.8, range=0..10), B=Slider(1.2, range=0..10))
scale_nu_2 = ScaleNU(
    Geometry=rotate.Geometry,
    Plane=PlaneXY(0, 0, 0),
    ScaleX=multiplication_2,
    ScaleY=multiplication_2,
    ScaleZ=multiplication_2)  # -> Geometry, Transform
xy = XYPlane(Origin=Point(0, 0, 0))
# Generative Design
contour = ContourEx(Shape=scale_nu_2.Geometry, Plane=xy, Distances=[Slider(1, range=0..1), Slider(4, range=0..10)])
boundary = BoundarySurfaces(Edges=contour)
Z_3 = UnitZ(Factor=Slider(0.2, range=0..1))
extr = Extrude(Base=boundary, Direction=Z_3)

# ----
mesh = Mesh(item_8)
mesh_to_quad_faces_2 = MeshToQuadFaces(M=mesh)
mesh_2 = Mesh(mesh_to_quad_faces_2)

genes = GenePool(Decimals=0, Maximum=1000, Minimum=-1000, Value=[-318, 785, 237, -557, 908, 205, 402, 454, -779, -65])
path_mapper = PathMapper(genes, source="{A}(i)", target="{i % 5}")
item_9 = ListItem(List=path_mapper, Index=0, Wrap=True)  # -> Item, Item1
vec_4 = VectorXYZ(XComponent=item_9.Item, YComponent=0, ZComponent=item_9.Item1)  # -> flatten(Vector), Length
split_3 = SplitList(List=vec_4.Vector, Index="3")  # -> ListA, ListB

# ---- group: Ramp
number_slider_6 = Slider(6, range=0..10)  # disabled
xz = XZPlane(Origin=Point(0, 0, 0))  # disabled
number_slider_7 = Slider(4, range=0..10)  # disabled
rot3d = Rotate3D(Geometry=xy, Angle=degrees(number_slider_6), Center=xy, Axis=xz)  # -> Geometry, Transform; disabled
contour_2 = ContourEx(Shape=scale_nu_2.Geometry, Plane=rot3d.Geometry, Distances=number_slider_7)  # disabled
number_slider_8 = Slider(-0.01, range=-0.01..1)  # disabled
cluster_2 = Cluster(F=number_slider_8, B=contour_2, A=contour_2, E=contour_2)  # disabled
number_slider_9 = Slider(0.2, range=0..1)  # disabled
Z_4 = UnitZ(Factor=number_slider_9)  # disabled
extr_2 = Extrude(Base=cluster_2, Direction=Z_4)  # disabled

# ---- group: Unitize Normals
cluster_3 = Cluster_3(L=mesh_2, L_2=mesh_2, M=mesh_2)

# ----
panel_3 = Panel(path_mapper)
crv = Curve([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])
crv_2 = Curve([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])

# ---- group: Geometry Inputs
srf = Surface(<surface referenced from the Rhino model>)
move_3 = Move(Geometry=crv_2, Motion=split_3.ListA)  # -> Geometry, Transform
move_4 = Move(Geometry=crv, Motion=split_3.ListB)  # -> Geometry, Transform
crv_density_curves = RemoteSender(move_4.Geometry)
facade_surface = RemoteSender(srf)
crv_voids = RemoteSender(move_3.Geometry)

# ---- group: transversal lines / mesh structure
facade_surface_2 = RemoteReceiver(facade_surface)
mplane = MeshPlane(Boundary=facade_surface_2, WidthCount=Slider(3, range=0..100), HeightCount=Slider(8, range=0..100))  # -> Mesh, Area
wbsplitquads = WeaverbirdsConstantQuadsSplitSubdivision(MeshCurves=mplane.Mesh, Level=Slider(2, range=0..10), SmoothNakedEdges="0")
explode = MeshExplode(Mesh=wbsplitquads, Interpolate=False)
demesh = DeconstructMesh(Mesh=explode)  # -> Vertices, Faces, Colours, Normals

# ----
facade_surface_3 = RemoteReceiver(facade_surface)
facade_surface_4 = RemoteReceiver(facade_surface)
facade_surface_5 = RemoteReceiver(facade_surface)
crv_voids_2 = RemoteReceiver(crv_voids)

vlen = VectorLength()  # disabled
bnd = Bounds()  # disabled
dedomain = DeconstructDomain(Domain=bnd)  # -> Start, End; disabled
ma = MassAddition(Input=vlen)  # -> Result, PartialResults; disabled
panel_4 = Panel(ma.Result)  # disabled
panel_5 = Panel(dedomain.End)  # disabled
num_total_displacement = RemoteSender(ma.Result)  # disabled
num_max_utilization = RemoteSender(dedomain.End)  # disabled

crv_3 = Curve(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)
center = Center(Geometry=crv_3)  # -> Center, Dimension
crv_4 = Curve(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)
crv_5 = Curve(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)
crv_6 = Curve(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)
l2_control_curve = RemoteSender(crv_6)
crv_7 = Curve(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)
l3_control_curve = RemoteSender(crv_7)
crv_8 = Curve(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)
scale = Scale(Geometry=crv_3, Center=center.Center, Factor=Slider(0.001, range=0..0.001))  # -> Geometry, Transform
T = StateGate(States=Toggle(True))  # -> True, False
galaplist = GalapagosListener(Reset=True)  # -> Fitness, Iterations
panel_6 = Panel("""0.5
0.3
0.2
0.3
0.4""")

mesh_3 = Mesh(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)
repeat = RepeatData(Data=mesh_3, Length=Slider(20, range=0..100))
number_slider_10 = Slider(10, range=0..10)
grid = ArrangeInGrid(Geometry=repeat, ItemsInRow=Slider(5, range=0..10), Spacing=Slider(15, range=0..100))  # -> TransformedGeometry, Transforms
vec_5 = VectorXYZ(XComponent=Slider(-36, range=-50..100), YComponent=Slider(-25, range=-50..100), ZComponent=0)  # -> Vector, Length
move_5 = Move(Geometry=grid.TransformedGeometry, Motion=vec_5.Vector)  # -> Geometry, Transform
series_2 = Series(Start=0, Step=30, Count=20)
center_2 = Center(Geometry=move_5.Geometry)  # -> Center, Dimension
rotate_2 = Rotate(Geometry=move_5.Geometry, Angle=degrees(series_2), Plane=center_2.Center)  # -> Geometry, Transform

# ---- group: Camera Setup
# Camera Setup
cir_2 = Circle(Plane=PlaneXY(0, 0, 0), Radius=Slider(46, range=0..100))
Z_5 = UnitZ(Factor=Slider(24.99, range=0..50))
# Rendering
move_6 = Move(Geometry=cir_2, Motion=Z_5)  # -> Geometry, Transform
divide_2 = DivideCurve(Curve=move_6.Geometry, Count=10, Kinks=False)  # -> Points, Tangents, Parameters
vec_6 = VectorXYZ(XComponent=Slider(16, range=-20..30), YComponent=Slider(24, range=-20..50), ZComponent=Slider(0, range=0..20))  # -> Vector, Length
center_3 = Center(Geometry=scale_nu.Geometry)  # -> Center, Dimension
move_7 = Move(Geometry=center_3.Center, Motion=vec_6.Vector)  # -> Geometry, Transform
item_10 = ListItem(List=divide_2.Points, Index=Slider(0, range=0..10), Wrap=True)
camera = VRayCamera(
    Position=item_10,
    Target=move_7.Geometry,
    FOV=Slider(57, range=0..100),
    Tilt=0,
    OrthographicZoomFactor=0,
    PhysicalExposureOn=invert(False),
    FNumber=Slider(12, range=0..100),
    ShutterSpeed1S=Slider(286, range=0..1000),
    FilmSensitivity=625)  # -> Camera, Angle

# ---- group: Infinite Plane
mtl_preset = VRayMaterialPreset(Preset=Slider(5, range=0..10), MaterialColor=ColourSwatch(SwatchColor=RGB(212, 212, 212)))
inf_plane = VRayInfinitePlane(Mtl=mtl_preset, ShadowCatcherOn=False, ZOffset=0, PositionFromGeometry=True)

# ---- group: Light Setup
open_file = Texture(
    "D:\Roberto\02 Resources\07 HDRI's\HDRI Skydomes Vol 2\VP_Skydome_15\VP Skydome 15\02 HDRI skydome\VP_hdri_skydome_15.exr",
    File_Picker=0,
    File_Types="All Image Files (*.png; *.bmp; *.tga; *.hdr; *.dgi; *.rgb; *.rgba; *.jpg; *.jpeg; *.exr; *.pic; *.tif; *.tiff)|*.png;*.bmp;*.tga;*.hdr;*.dgi;*.rgb;*.rgba;*.jpg;*.jpeg;*.exr;*.pic;*.tif;*.tiff|Portable Network Graphics (*.png)|*.png|Windows bitmap (*.bmp)|*.bmp|Targa Image (*.tga)|*.tga|Radiance High-Dynamyc Range (*.hdr)|*.hdr|Silicon Graphics (*.sgi; *.rgb; *.rgba)|*.dgi;*.rgb;*.rgba|JPEG image (*.jpg; *.jpeg)|*.jpg;*.jpeg|OpenEXR image (*.exr)|*.exr|SoftImage PICT (*.pic)|*.pic|Tagged image (*.tif; *.tiff)|*.tif;*.tiff",
    Has_Extract_Parameter=False,
    Has_Manage_Collection=True,
    Has_Multiple_Files_Menu=False,
    Has_Picker_File_Menu=False,
    Multiple_Files=False)
# Materials
rig_dome = VRayLightRigDome(
    LightOn=Toggle(True),
    Visible=invert(Toggle(True)),
    Texture=open_file,
    Intensity=Slider(1, range=0..1),
    Rotation=Slider(0, range=0..360),
    BackgroundIntensity=1)

# ---- group: People
mtl_name = VRayMaterialFromProject(
    Has_Extract_Parameter=True,
    Has_Manage_Collection=False,
    OptionsLength=8,
    Options=["/Aluminum_Polished", "/Glass_Window_Neutral", "/Laminate_B01_120cm", "/Laminate_C01_120cm", "/Laminate_C02_120cm", "/Plywood_A_50cm", "/Plywood_B_50cm", "/Plywood_C_50cm"])
vgeo = VRayGeometry(Geo=rotate_2.Geometry, Material=mtl_name)

# ---- group: Geometry for lighting setup
mtl_name_2 = VRayMaterialFromProject(
    Has_Extract_Parameter=True,
    Has_Manage_Collection=False,
    OptionsLength=8,
    Options=["/Aluminum_Polished", "/Glass_Window_Neutral", "/Laminate_B01_120cm", "/Laminate_C01_120cm", "/Laminate_C02_120cm", "/Plywood_A_50cm", "/Plywood_B_50cm", "/Plywood_C_50cm"])
geo = Geometry(flatten(<brep referenced from the Rhino model>))
vgeo_2 = VRayGeometry(Geo=flatten([extr, geo]), Material=mtl_name_2)

# ---- group: Windows
mtl_name_3 = VRayMaterialFromProject(
    Has_Extract_Parameter=True,
    Has_Manage_Collection=False,
    OptionsLength=8,
    Options=["/Aluminum_Polished", "/Glass_Window_Neutral", "/Laminate_B01_120cm", "/Laminate_C01_120cm", "/Laminate_C02_120cm", "/Plywood_A_50cm", "/Plywood_B_50cm", "/Plywood_C_50cm"])
vgeo_3 = VRayGeometry(Geo=cluster, Material=mtl_name_3)

# ---- group: Outer Shell
mtl_name_4 = VRayMaterialFromProject(
    Has_Extract_Parameter=True,
    Has_Manage_Collection=False,
    OptionsLength=8,
    Options=["/Aluminum_Polished", "/Glass_Window_Neutral", "/Laminate_B01_120cm", "/Laminate_C01_120cm", "/Laminate_C02_120cm", "/Plywood_A_50cm", "/Plywood_B_50cm", "/Plywood_C_50cm"])
vgeo_4 = VRayGeometry(Geo=item_6, Material=mtl_name_4)

# ----
lighting_analysis = VRayElementLightingAnalysis(ValueRange=Domain(500, 2000), GridSpacing=40, FadeImage=True, DrawLegend=True)
camera_2 = CameraCrane(
    LocationOptional=item_10,
    TargetOptional=move_7.Geometry,
    LensOptional=Slider(33, range=0..100),
    ViewNameOptional="Perspective",
    Size=2,
    ActivationOptional=True)  # -> LocationOptional, TargetOptional, LensOptional, UpOptional, FRect, BRect, HorizontalViewAngle, VerticalViewAngle, ScreenRatio

# ---- group: Construct SQL Query and Get Data
panel_7 = Panel("""*, (
      3959 * acos (
      cos ( radians(41) )
      * cos( radians( lat ) )
      * cos( radians( lng ) - radians(3) )
      + sin ( radians(41) )
      * sin( radians( lat ) )
    )
) AS distance""")
panel_8 = Panel("""x BETWEEN {0} AND {1} AND 
y BETWEEN {2} AND {3} AND 
z BETWEEN {4} AND {5} AND
 quality > {6} 
GROUP BY id 
HAVING distance < {7} """)

# ----
# Density
# Fibre Stress at Elastic Limit
# Modulus of Elasticity (E)
# Compressive Strength Parallel to Grain
# (Shear Strength Parallel to Grain
path = FilePath("D:\Roberto\01 Projects\02 IAAC\02 Curso\Software III\Week 4\Database_ui\wood_data.csv")
file = ReadFile(File=path, PerLineParse=True)
csv = ReadCSV(CSVString=file, Delimiter=",")  # -> Headers, Values
flip = FlipMatrix(Data=csv.Values)
split_4 = SplitList(List=flip, Index="1")  # -> simplify(ListA), simplify(ListB)
cset = CreateSet(List=flatten(split_4.ListA))  # -> Set, Map
txt_available_species = Text(flatten(split_4.ListA))
txt_available_species_2 = RemoteSender(txt_available_species)
panel_9 = Panel("""kg/m3
MPa
GPa
MPa
MPa""")

toggle = CreateToggle(Default=False, Label="Query Database")
label_2 = CreateLabel(LabelText=" ", LabelSize="20", Justification="2")
merge = Merge(Data1=toggle, Data2=label_2)
stack = CreateStack(UIElements=merge, Horizontal=True)

panel_10 = Panel("0.1 to 0.1")
label_3 = CreateLabel(LabelText="Height Range", LabelSize=12, Justification=0)

rangeslider = CreateRangeSlider(SliderRange="0.03 to 0.075", StartingRange="0.03 to 0.075")
label_4 = CreateLabel(LabelText="Width Range", LabelSize=12, Justification=0)
merge_2 = Merge(Data1=label_4, Data2=rangeslider)

rangeslider_2 = CreateRangeSlider(SliderRange="0.1 to 3.5", StartingRange="0.1 to 3.5")
label_5 = CreateLabel(LabelText="Length Range", LabelSize=12, Justification=0)
merge_3 = Merge(Data1=label_5, Data2=rangeslider_2)

# ---- group: Testing : Generate Database Entries
# If the param in the database  are modified remember to refresh the information with the button: Clear Database
# Makes the database update in one chunk > faster performance
number_slider_11 = Slider(5000, range=0..10000)
txt_available_species_3 = RemoteReceiver(txt_available_species_2)
panel_11 = Panel("0.1 to 3.5")
lng = ListLength(List=txt_available_species_3)
panel_12 = Panel("0.03 to 0.075")
panel_13 = Panel("0.03 to 0.075")
random_2 = Random(Range=lng, Number=number_slider_11, Seed=item_2.Item4)
int = Integer(random_2)
random_3 = Random(Range=panel_11, Number=number_slider_11, Seed=item_2.Item)
random_4 = Random(Range=panel_13, Number=number_slider_11, Seed=item_2.Item1)
random_5 = Random(Range=panel_12, Number=number_slider_11, Seed=item_2.Item2)
random_6 = Random(Range="0 to 1", Number=number_slider_11, Seed=item_2.Item3)
random_7 = Random(Range="2 to 4", Number=number_slider_11, Seed=item_2.Item6)
series_3 = Series(Start=0, Step=1, Count=number_slider_11)
item_11 = ListItem(List=txt_available_species_3, Index=int, Wrap=True)
random_8 = Random(Range="40 to 42", Number=number_slider_11, Seed=item_2.Item5)
merge_4 = Merge(
    Data1=simplify(graft(series_3)),
    Data2=simplify(graft(random_3)),
    Data3=simplify(graft(random_4)),
    Data4=simplify(graft(random_5)),
    Data5=simplify(graft(random_6)),
    Data6=simplify(graft(item_11)),
    Data7=simplify(graft(random_8)),
    Data8=simplify(graft(random_7)))
sqlformatrows = SQLFormatRows(RowDataList=merge_4)  # -> flatten(RowStrings)
panel_14 = Panel("""id
x
y
z
quality
species
lat
lng""")
panel_15 = Panel("""BEGIN TRANSACTION;
COMMIT;""")
insert = SQLInsertCommand(Table="items", Columns=panel_14, Data=sqlformatrows, Update=False, Connector="MySQL")
ins = InsertItems(List=panel_15, Item=insert, Indices="1", Wrap=True)
command_2 = RDBFileCommand(
    ConnectToggle=Button(),
    SQLCommand=ins,
    Connector="SQLite",
    Path="D:\Roberto\01 Projects\02 IAAC\02 Curso\Software III\Week 4\Database_ui\material_database.s3db")
panel_16 = Panel(command_2)

# ----
rangeslider_3 = CreateRangeSlider(SliderRange="0.03 to 0.075", StartingRange="0.03 to 0.075")
merge_5 = Merge(Data1=label_3, Data2=rangeslider_3)

merge_6 = Merge(Data1=merge_3, Data2=merge_2, Data3=merge_5, Data4=label, Data5=slider_2, Data6=slider, Data7=stack)

# ---- group: UI Core
data_elements = Data(merge_6)
launchxpwin = LaunchTransparentWindow(Show=Toggle(True), Name="Database Parameters", Width=370, Height=400, ChildStatus=0, EnableHorizScroll=False)
addelems = AddElements(Window=launchxpwin, Elements=flatten(data_elements), DoVLChecking=True)  # -> AddedElements, ElementNames
values = ValueListener(Elements=addelems.AddedElements, SomeProperty=True)  # -> Values, Indices
item_12 = ListItem(List=flatten(values.Values), Index=0, Wrap=True)  # -> Item, Item1, Item2, Item3, Item4, Item5, Item6, Item7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
panel_17 = Panel(item_12.Item11)
panel_18 = Panel(item_12.Item12)
boolean_query_database = RemoteSender(item_12.Item9)
num_maximum_distance = RemoteSender(item_12.Item8)
num_min_quality = RemoteSender(item_12.Item7)
domain_height = RemoteSender(item_12.Item5)
domain_length = RemoteSender(item_12.Item1)
domain_width = RemoteSender(item_12.Item3)

# ----
domain_height_2 = RemoteReceiver(domain_height)
dedomain_2 = DeconstructDomain(Domain=domain_height_2)  # -> Start, End
expression = Expression(x=dedomain_2.Start, Expression="round(x * 100) / 100")
expression_2 = Expression(x=dedomain_2.End, Expression="round(x * 100) / 100")
format = Format(Format="Height Range : ({0} : {1})", Culture=127, Data0=expression, Data1=expression_2)
setlabel = SetLabelContents(LabelToModify=label_3, NewLabelContents=format)

domain_length_2 = RemoteReceiver(domain_length)
dedomain_3 = DeconstructDomain(Domain=domain_length_2)  # -> Start, End
expression_3 = Expression(x=dedomain_3.Start, Expression="round(x * 100) / 100")
expression_4 = Expression(x=dedomain_3.End, Expression="round(x * 100) / 100")
format_2 = Format(Format="Length Range : ({0} : {1})", Culture=127, Data0=expression_3, Data1=expression_4)
setlabel_2 = SetLabelContents(LabelToModify=label_5, NewLabelContents=format_2)

domain_width_2 = RemoteReceiver(domain_width)
dedomain_4 = DeconstructDomain(Domain=domain_width_2)  # -> Start, End
expression_5 = Expression(x=dedomain_4.Start, Expression="round(x * 100) / 100")
expression_6 = Expression(x=dedomain_4.End, Expression="round(x * 100) / 100")
format_3 = Format(Format="Width Range : ({0} : {1})", Culture=127, Data0=expression_5, Data1=expression_6)
setlabel_3 = SetLabelContents(LabelToModify=label_4, NewLabelContents=format_3)

# ---- group: Construct SQL Query and Get Data (continued)
domain_length_3 = RemoteReceiver(domain_length)
domain_height_3 = RemoteReceiver(domain_height)
domain_width_3 = RemoteReceiver(domain_width)
num_maximum_distance_2 = RemoteReceiver(num_maximum_distance)
num_min_quality_2 = RemoteReceiver(num_min_quality)
dedomain_5 = DeconstructDomain(Domain=domain_length_3)  # -> Start, End
dedomain_6 = DeconstructDomain(Domain=domain_width_3)  # -> Start, End
dedomain_7 = DeconstructDomain(Domain=domain_height_3)  # -> Start, End
format_4 = Format(
    Format=panel_8,
    Culture=127,
    Data0=dedomain_5.Start,
    Data1=dedomain_5.End,
    Data2=dedomain_6.Start,
    Data3=dedomain_6.End,
    Data4=dedomain_7.Start,
    Data5=dedomain_7.End,
    Data6=num_min_quality_2,
    Data7=num_maximum_distance_2)
# Material Database
boolean_query_database_2 = RemoteReceiver(boolean_query_database)
querysfw = SQLSELECTString(Select=panel_7, From="items", Where=format_4, Connector="MySQL")
query = RDBFileQuery(
    ConnectToggle=boolean_query_database_2,
    SQLQuery=querysfw,
    Database="SQLite",
    Path="D:\Roberto\01 Projects\02 IAAC\02 Curso\Software III\Week 4\Database_ui\material_database.s3db")  # -> Exceptions, TableHeadings, TableData
flip_2 = FlipMatrix(Data=query.TableData)
tstat = TreeStatistics(Tree=flip_2)  # -> Paths, Length, Count
dam = DataDam(DataA=flip_2, BufferDelay=10000000, BufferMode=1)
python = GhPythonScript(n=tstat.Count)  # -> a
# ---------- python: Python ----------
__author__ = "matt"
__version__ = "2020.04.26"

import rhinoscriptsyntax as rs

if n == None:
    a = "0"
else:
    a = n
# ---------- end python ----------
item_13 = ListItem(List=simplify(dam), Index=0, Wrap=True)  # -> flatten(Item), flatten(Item1), flatten(Item2), flatten(Item3), flatten(Item4), flatten(Item5), flatten(Item6), flatten(Item7), flatten(Item8)
num_db_item_count = RemoteSender(python)
int_2 = Integer(item_13.Item)
num_2 = Number(item_13.Item1)
num_3 = Number(item_13.Item2)
num_4 = Number(item_13.Item3)
txt = Text(item_13.Item5)
num_5 = Number(item_13.Item6)
num_6 = Number(item_13.Item7)
num_7 = Number(item_13.Item8)
num_8 = Number(item_13.Item4)
items_distance = RemoteSender(num_7)
items_species = RemoteSender(txt)
items_quality = RemoteSender(num_8)
items_ids = RemoteSender(int_2)
items_x = RemoteSender(num_2)
items_y = RemoteSender(num_3)
items_z = RemoteSender(num_4)

# ----
num_db_item_count_2 = RemoteReceiver(num_db_item_count)
format_5 = Format(Format="        Items : {0}", Culture=127, Data0=num_db_item_count_2)
setlabel_4 = SetLabelContents(LabelToModify=label_2, NewLabelContents=format_5)

txt_query = Text(items_species)
mindex_4 = MemberIndex(Set=cset.Set, Member=txt_query)  # -> flatten(Index), Count
branch = TreeBranch(Tree=split_4.ListB, Path=mindex_4.Index, MaintainPaths=False)
item_14 = ListItem(List=simplify(branch), Index=0, Wrap=True)  # -> Item, Item1, Item2, Item3, Item4
num_strength_compressive = Number(flatten(item_14.Item3))
num_strength_shear = Number(flatten(item_14.Item4))
num_fiber_stress = Number(flatten(item_14.Item1))
num_density = Number(flatten(item_14.Item))
num_e = Number(flatten(item_14.Item2))
num_strength_compressive_2 = RemoteSender(num_strength_compressive)
num_strength_shear_2 = RemoteSender(num_strength_shear)
num_fiber_stress_2 = RemoteSender(num_fiber_stress)
num_density_2 = RemoteSender(num_density)
num_e_2 = RemoteSender(num_e)

panel_19 = Panel(query.TableData)
panel_20 = Panel(items_z)
items_y_2 = RemoteReceiver(items_y)

items_distance_2 = RemoteReceiver(items_distance)
items_x_2 = RemoteReceiver(items_x)
remap = RemapNumbers(Value=items_distance_2, Source="0.1 to 1", Target="1")  # -> Mapped, Clipped
remap_2 = RemapNumbers(Value=items_x_2, Source="0.001 to 0.15", Target="2")  # -> Mapped, Clipped
# Database Visualization
pt_2 = ConstructPoint(XCoordinate=Slider(-9, range=-40..100), YCoordinate=Slider(5, range=-20..20), ZCoordinate=Slider(0, range=0..100))
vec_7 = VectorXYZ(XComponent=remap.Mapped, YComponent=remap_2.Mapped, ZComponent=0)  # -> Vector, Length
items_y_3 = RemoteReceiver(items_y)
items_x_3 = RemoteReceiver(items_x)
items_z_2 = RemoteReceiver(items_z)
box = DomainBox(Base=pt_2, X=items_y_3, Y=items_z_2, Z=items_x_3)
move_8 = Move(Geometry=box, Motion=vec_7.Vector)  # -> Geometry, Transform
items_quality_2 = RemoteReceiver(items_quality)
dataset_geometry = RemoteSender(move_8.Geometry)
ln = Line(StartPoint="200,200,200", EndPoint="0.1,0.1,0.1")
eval = EvaluateCurve(Curve=reparameterize(ln), Parameter=items_quality_2)  # -> Point, Tangent, Angle
pdecon = Deconstruct(Point=eval.Point)  # -> XComponent, YComponent, ZComponent
rgb = ColourRGB(Alpha=255, Red=pdecon.XComponent, Green=pdecon.YComponent, Blue=pdecon.ZComponent)

move_9 = Move(Geometry=move_8.Geometry, Motion=vec.Vector)  # -> Geometry, Transform

# ---- group: Dataset
mtl_name_5 = VRayMaterialFromProject(
    Has_Extract_Parameter=True,
    Has_Manage_Collection=False,
    OptionsLength=8,
    Options=["/Aluminum_Polished", "/Glass_Window_Neutral", "/Laminate_B01_120cm", "/Laminate_C01_120cm", "/Laminate_C02_120cm", "/Plywood_A_50cm", "/Plywood_B_50cm", "/Plywood_C_50cm"])
vgeo_5 = VRayGeometry(Geo=move_9.Geometry, Material=mtl_name_5)

# ----
panel_21 = Panel("""0.25
0.5
0.75""")  # disabled
panel_22 = Panel(".001")  # disabled
panel_23 = Panel(".0501")  # disabled

# ---- group: Attempts to cull unsupported elements
panel_24 = Panel("int(x*10) / 10")  # disabled
panel_25 = Panel("1")  # disabled

# ---- group: level 1 / mesh
crv_density_curves_2 = RemoteReceiver(crv_density_curves)
number_slider_12 = Slider(-16, range=-16..0)
merge_7 = Merge(Data1=crv_density_curves_2)
Y = UnitY(Factor=number_slider_12)
move_10 = Move(Geometry=merge_7, Motion=Y)  # -> Geometry, Transform

# ---- group: mesh
crv_density_curves_3 = RemoteReceiver(crv_density_curves)
number_slider_13 = Slider(-2400, range=-10000..0)
merge_8 = Merge(Data1=crv_density_curves_3)
Y_2 = UnitY(Factor=number_slider_13)
mplane_2 = MeshPlane(Boundary=facade_surface_5, WidthCount=Slider(12, range=0..100), HeightCount=Slider(8, range=0..100))  # -> Mesh, Area
move_11 = Move(Geometry=merge_8, Motion=Y_2)  # -> Geometry, Transform

# ----
d3 = RemoteSender(number_slider_13)

# ---- group: level 2 / mesh
crv_density_curves_4 = RemoteReceiver(crv_density_curves)
number_slider_14 = Slider(-2, range=-2..0)
merge_9 = Merge(Data1=crv_density_curves_4)
Y_3 = UnitY(Factor=number_slider_14)
mplane_3 = MeshPlane(Boundary=facade_surface_4, WidthCount=Slider(12, range=0..100), HeightCount=Slider(8, range=0..100))  # -> Mesh, Area
move_12 = Move(Geometry=merge_9, Motion=Y_3)  # -> Geometry, Transform

# ----
d2 = RemoteSender(number_slider_14)

# ---- group: level 0 / mesh
number_slider_15 = Slider(-10, range=-10..0)
crv_density_curves_5 = RemoteReceiver(crv_density_curves)
merge_10 = Merge(Data1=crv_density_curves_5)
Y_4 = UnitY(Factor=number_slider_15)
mplane_4 = MeshPlane(Boundary=facade_surface_3, WidthCount=Slider(12, range=0..100), HeightCount=Slider(8, range=0..100))  # -> Mesh, Area
move_13 = Move(Geometry=merge_10, Motion=Y_4)  # -> Geometry, Transform

# ----
d0 = RemoteSender(number_slider_15)

# ---- group: level 0_cable structure / cable structure
explode_2 = MeshExplode(Mesh=mplane_4.Mesh, Interpolate=False)
demesh_2 = DeconstructMesh(Mesh=explode_2)  # -> Vertices, Faces, Colours, Normals
item_15 = ListItem(List=demesh_2.Vertices, Index=0, Wrap=True)  # -> Item, Item1, Item2, Item3
ln_2 = Line(StartPoint=item_15.Item1, EndPoint=item_15.Item2)

# ---- group: level 1
facade_surface_6 = RemoteReceiver(facade_surface)
d1 = RemoteSender(number_slider_12)
number_slider_16 = Slider(16, range=0..100)
width_2 = RemoteReceiver(width)
height_2 = RemoteReceiver(height)

# ---- group: level 1 / path / control lines
divide_3 = DivideCurve(Curve=crv_3, Count=Slider(40, range=0..100), Kinks=False)  # -> Points, Tangents, Parameters
divide_4 = DivideCurve(Curve=crv_4, Count=number_slider_16, Kinks=False)  # -> Points, Tangents, Parameters
pull = PullPoint(Point=divide_3.Points, Geometry=divide_4.Points, ClosestOnly=True)  # -> ClosestPoint, Distance
ln_3 = Line(StartPoint=divide_3.Points, EndPoint=pull.ClosestPoint)

# ---- group: level 1 / mesh (continued)
mplane_5 = MeshPlane(Boundary=facade_surface_6, WidthCount=Slider(12, range=0..100), HeightCount=Slider(8, range=0..100))  # -> Mesh, Area

# ---- group: level 1 (continued)
move_14 = Move(Geometry=mplane_5.Mesh, Motion=Y)  # -> Geometry, Transform

# ---- group: level 1 / mesh (continued)
facen_2 = FaceNormals(Mesh=move_14.Geometry)  # -> Centers, Normals
explode_3 = MeshExplode(Mesh=move_14.Geometry, Interpolate=False)
pull_2 = PullPoint(Point=facen_2.Centers, Geometry=move_10.Geometry, ClosestOnly=True)  # -> ClosestPoint, Distance

# ---- group: level 2
move_15 = Move(Geometry=mplane_3.Mesh, Motion=Y_3)  # -> Geometry, Transform
number_slider_17 = Slider(10, range=0..100)
width_3 = RemoteReceiver(width)
height_3 = RemoteReceiver(height)

# ---- group: level 2 / mesh (continued)
facen_3 = FaceNormals(Mesh=move_15.Geometry)  # -> Centers, Normals
explode_4 = MeshExplode(Mesh=move_15.Geometry, Interpolate=False)
pull_3 = PullPoint(Point=facen_3.Centers, Geometry=move_12.Geometry, ClosestOnly=True)  # -> ClosestPoint, Distance

# ---- group: level 2
divide_5 = DivideCurve(Curve=crv_5, Count=Slider(12, range=0..100), Kinks=False)  # -> Points, Tangents, Parameters
divide_6 = DivideCurve(Curve=crv_6, Count=number_slider_17, Kinks=False)  # -> Points, Tangents, Parameters
pull_4 = PullPoint(Point=divide_5.Points, Geometry=divide_6.Points, ClosestOnly=True)  # -> ClosestPoint, Distance
ln_4 = Line(StartPoint=divide_5.Points, EndPoint=pull_4.ClosestPoint)

# ----
move_16 = Move(Geometry=mplane_2.Mesh, Motion=Y_2)  # -> Geometry, Transform
width_4 = RemoteReceiver(width)
height_4 = RemoteReceiver(height)

# ---- group: mesh (continued)
facen_4 = FaceNormals(Mesh=move_16.Geometry)  # -> Centers, Normals
explode_5 = MeshExplode(Mesh=move_16.Geometry, Interpolate=False)
pull_5 = PullPoint(Point=facen_4.Centers, Geometry=move_11.Geometry, ClosestOnly=True)  # -> ClosestPoint, Distance

# ----
divide_7 = DivideCurve(Curve=crv_8, Count=Slider(12, range=0..100), Kinks=False)  # -> Points, Tangents, Parameters
divide_8 = DivideCurve(Curve=crv_7, Count=Slider(10, range=0..100), Kinks=False)  # -> Points, Tangents, Parameters
pull_6 = PullPoint(Point=divide_7.Points, Geometry=divide_8.Points, ClosestOnly=True)  # -> ClosestPoint, Distance
ln_5 = Line(StartPoint=divide_7.Points, EndPoint=pull_6.ClosestPoint)

# ---- group: level 0
move_17 = Move(Geometry=mplane_4.Mesh, Motion=Y_4)  # -> Geometry, Transform
move_18 = Move(Geometry=crv_voids_2, Motion=Y_4)  # -> Geometry, Transform
width_5 = RemoteReceiver(width)
height_5 = RemoteReceiver(height)

# ---- group: level 0 / mesh (continued)
facen_5 = FaceNormals(Mesh=move_17.Geometry)  # -> Centers, Normals
explode_6 = MeshExplode(Mesh=move_17.Geometry, Interpolate=False)
pull_7 = PullPoint(Point=facen_5.Centers, Geometry=move_13.Geometry, ClosestOnly=True)  # -> ClosestPoint, Distance

# ----
series_4 = Series(Start=0, Step=1, Count=10)
python_k_ary_neckalces = GhPythonScript(n="6")  # -> a; inputs n: Int32
# ---------- python_k_ary_neckalces: Python ----------
from itertools import permutations 
import ghpythonlib.treehelpers as tr

a = list(permutations(list(range(n-1))))

a = [[n-1] + list(l) for l in a]

a = tr.list_to_tree(a)
# ---------- end python_k_ary_neckalces ----------
genes_2 = GenePool(
    Decimals=0,
    Maximum=10,
    Minimum=0,
    Value=[2.476528372, 6.064654191, 6.685752881, 6.728215104, 7.192133668, 6.546750016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])
repeat_2 = RepeatData(Data=series_4, Length=Slider(1666, range=0..2000))
join = TextJoin(Text=python_k_ary_neckalces)  # -> flatten(Result)
jitter = Jitter(List=repeat_2, Jitter=1, Seed=Slider(10, range=0..100))  # -> Values, Indices
jitter_2 = Jitter(List=join, Jitter=1, Seed=2)  # -> Values, Indices
item_16 = ListItem(List=flatten(jitter_2.Values), Index=jitter.Values, Wrap=True)
chars = Characters(Text=item_16)  # -> simplify(Result), Unicode

# ---- group: level 1 / grid subdivision
smaller = SmallerThan(FirstNumber=pull_2.Distance, SecondNumber=number_slider)  # -> SmallerThan, OrEqualTo
dispatch = Dispatch(List=explode_3, DispatchPattern=smaller.SmallerThan)  # -> ListA, ListB
grid_1 = Mesh(dispatch.ListB)
wbsplitquads_2 = WeaverbirdsConstantQuadsSplitSubdivision(MeshCurves=grid_1, Level=Slider(2, range=0..10), SmoothNakedEdges="0")

# ---- group: level 1 / grid subdivision / grid 0
mesh_4 = Mesh(dispatch.ListA)

# ---- group: level 1 / grid subdivision (continued)
merge_11 = Merge(Data1=mesh_4, Data2=wbsplitquads_2)

# ---- group: level 2 / grid subdivision
smaller_2 = SmallerThan(FirstNumber=pull_3.Distance, SecondNumber=number_slider_2)  # -> SmallerThan, OrEqualTo
dispatch_2 = Dispatch(List=explode_4, DispatchPattern=smaller_2.SmallerThan)  # -> ListA, ListB
grid_1_2 = Mesh(dispatch_2.ListB)
wbsplitquads_3 = WeaverbirdsConstantQuadsSplitSubdivision(MeshCurves=grid_1_2, Level=Slider(2, range=0..10), SmoothNakedEdges="0")

# ---- group: level 2 / grid subdivision / grid 0
mesh_5 = Mesh(dispatch_2.ListA)

# ---- group: level 2 / grid subdivision (continued)
merge_12 = Merge(Data1=mesh_5, Data2=wbsplitquads_3)

# ---- group: grid subdivision
smaller_3 = SmallerThan(FirstNumber=pull_5.Distance, SecondNumber=number_slider_5)  # -> SmallerThan, OrEqualTo
dispatch_3 = Dispatch(List=explode_5, DispatchPattern=smaller_3.SmallerThan)  # -> ListA, ListB
grid_1_3 = Mesh(dispatch_3.ListB)
wbsplitquads_4 = WeaverbirdsConstantQuadsSplitSubdivision(MeshCurves=grid_1_3, Level=Slider(1, range=0..10), SmoothNakedEdges="0")

# ---- group: grid subdivision / grid 0
mesh_6 = Mesh(dispatch_3.ListA)

# ---- group: grid subdivision (continued)
merge_13 = Merge(Data1=mesh_6, Data2=wbsplitquads_4)

# ---- group: level 0 / grid subdivision
smaller_4 = SmallerThan(FirstNumber=pull_7.Distance, SecondNumber=number_slider_4)  # -> SmallerThan, OrEqualTo
larger = LargerThan(FirstNumber=pull_7.Distance, SecondNumber=number_slider_3)  # -> LargerThan, OrEqualTo
dispatch_4 = Dispatch(List=explode_6, DispatchPattern=smaller_4.SmallerThan)  # -> ListA, ListB
dispatch_5 = Dispatch(List=explode_6, DispatchPattern=larger.LargerThan)  # -> ListA, ListB
grid_1_4 = Mesh(dispatch_4.ListB)
wbsplitquads_5 = WeaverbirdsConstantQuadsSplitSubdivision(MeshCurves=grid_1_4, Level=Slider(2, range=0..10), SmoothNakedEdges="0")

# ---- group: level 0 / grid subdivision / grid 0
mesh_7 = Mesh(dispatch_4.ListA)

# ---- group: level 0 / grid subdivision / grid 2
mesh_8 = Mesh(dispatch_5.ListA)

# ---- group: level 0 / grid subdivision (continued)
wbsplitquads_6 = WeaverbirdsConstantQuadsSplitSubdivision(MeshCurves=mesh_8, Level=Slider(3, range=0..10), SmoothNakedEdges="0")
merge_14 = Merge(Data1=mesh_7, Data2=wbsplitquads_5)

# ---- group: Find Suport Points
panel_26 = Panel("0.5")  # disabled

# ---- group: Window Frames
dom = ConstructDomain(DomainStart=0, DomainEnd=Slider(0.1, range=0..0.1))
rectangle = Rectangle(Plane=PlaneXY(0, 0, 0), XSize=dom, YSize=dom, Radius=Slider(0.05, range=0..0.1))  # -> Rectangle, Length
msweep = MeshSweep(RailCurve=quads, SectionCurve=rectangle.Rectangle, Accuracy=0.2, Cap=True, Autoorient=True, Rotation=0)
mjoin = MeshJoin(Meshes=msweep)

mtl_name_6 = VRayMaterialFromProject(
    Has_Extract_Parameter=True,
    Has_Manage_Collection=False,
    OptionsLength=8,
    Options=["/Aluminum_Polished", "/Glass_Window_Neutral", "/Laminate_B01_120cm", "/Laminate_C01_120cm", "/Laminate_C02_120cm", "/Plywood_A_50cm", "/Plywood_B_50cm", "/Plywood_C_50cm"])
vgeo_6 = VRayGeometry(Geo=mjoin, Material=mtl_name_6)

# ----
mjoin_2 = MeshJoin(Meshes=flatten(merge_13))

# ---- group: create openings
crv_voids_3 = RemoteReceiver(crv_voids)
move_19 = Move(Geometry=crv_voids_3, Motion=Y_2)  # -> Geometry, Transform
facen_6 = FaceNormals(Mesh=mjoin_2)  # -> Centers, Normals
boundary_2 = BoundarySurfaces(Edges=move_19.Geometry)
pull_8 = PullPoint(Point=facen_6.Centers, Geometry=boundary_2, ClosestOnly=True)  # -> ClosestPoint, Distance
smaller_5 = SmallerThan(FirstNumber=pull_8.Distance, SecondNumber=Slider(100, range=0..1000))  # -> SmallerThan, OrEqualTo
cullf = CullFaces(Mesh=mjoin_2, Pattern=smaller_5.SmallerThan)

# ---- group: lines diagonal v2
explode_7 = MeshExplode(Mesh=cullf, Interpolate=False)
demesh_3 = DeconstructMesh(Mesh=explode_7)  # -> Vertices, Faces, Colours, Normals
item_17 = ListItem(List=demesh_3.Vertices, Index=0, Wrap=True)  # -> Item, Item1, Item2, Item3
wbedges = WeaverbirdsMeshEdges(MeshOrPolylines=cullf)
ln_6 = Line(StartPoint=item_17.Item, EndPoint=item_17.Item2)

# ----
ln_7 = Line(StartPoint=item_17.Item1, EndPoint=item_17.Item3)
merge_15 = Merge(Data1=ln_6, Data2=ln_7, Data3=wbedges)  # -> flatten(Result)
shortwalk = ShortestWalk(Curves=merge_15, WantedPath=ln_5)  # -> ShortestWalk, Succession, Direction, Length
explode_8 = Explode(Curve=shortwalk.ShortestWalk, Recursive=True)  # -> Segments, Vertices
cluster_join_curves = ClusterJoinCurves(crv=explode_8.Segments)
midpt = CurveMiddle(Curve=cluster_join_curves)
l3_points = RemoteSender(cluster_join_curves)
len = Length(Curve=cluster_join_curves)
frame = CurveFrame(Curve=cluster_join_curves, Parameter=midpt)
frame_2 = CurveFrame(Curve=cluster_join_curves, Parameter="0")
pl_origin = PlaneOrigin(Base=frame, Origin=midpt)
box_2 = DomainBox(Base=frame_2, X=len, Y=width_4, Z=height_4)

# ---- group: transversal lines / transversal structure / P_03
pt_3 = Point(demesh.Vertices)
l3_points_2 = RemoteReceiver(l3_points)
flatten = FlattenTree(Tree=pt_3, Path="{0}")
pull_9 = PullPoint(Point=flatten, Geometry=l3_points_2, ClosestOnly=True)  # -> ClosestPoint, Distance
d3_2 = RemoteReceiver(d3)
smaller_6 = SmallerThan(FirstNumber=pull_9.Distance, SecondNumber=expr("-x+0.001", d3_2))  # -> SmallerThan, OrEqualTo
dispatch_6 = Dispatch(List=pull_9.ClosestPoint, DispatchPattern=smaller_6.OrEqualTo)  # -> ListA, ListB
pt_4 = Point(dispatch_6.ListA)

# ----
l3_points_3 = RemoteReceiver(l3_points)  # disabled

# ---- group: level 1 (continued)
mjoin_3 = MeshJoin(Meshes=flatten(merge_11))

# ---- group: level 1 / create openings
crv_voids_4 = RemoteReceiver(crv_voids)
move_20 = Move(Geometry=crv_voids_4, Motion=Y)  # -> Geometry, Transform
facen_7 = FaceNormals(Mesh=mjoin_3)  # -> Centers, Normals
boundary_3 = BoundarySurfaces(Edges=move_20.Geometry)
pull_10 = PullPoint(Point=facen_7.Centers, Geometry=boundary_3, ClosestOnly=True)  # -> ClosestPoint, Distance
smaller_7 = SmallerThan(FirstNumber=pull_10.Distance, SecondNumber=Slider(0.5, range=0..0.5))  # -> SmallerThan, OrEqualTo
cullf_2 = CullFaces(Mesh=mjoin_3, Pattern=smaller_7.SmallerThan)

# ---- group: level 1 / lines diagonal v2
explode_9 = MeshExplode(Mesh=cullf_2, Interpolate=False)
demesh_4 = DeconstructMesh(Mesh=explode_9)  # -> Vertices, Faces, Colours, Normals
item_18 = ListItem(List=demesh_4.Vertices, Index=0, Wrap=True)  # -> Item, Item1, Item2, Item3
wbedges_2 = WeaverbirdsMeshEdges(MeshOrPolylines=cullf_2)
ln_8 = Line(StartPoint=item_18.Item, EndPoint=item_18.Item2)

# ---- group: level 2 (continued)
mjoin_4 = MeshJoin(Meshes=flatten(merge_12))

# ---- group: level 2 / create openings
crv_voids_5 = RemoteReceiver(crv_voids)
move_21 = Move(Geometry=crv_voids_5, Motion=Y_3)  # -> Geometry, Transform
facen_8 = FaceNormals(Mesh=mjoin_4)  # -> Centers, Normals
boundary_4 = BoundarySurfaces(Edges=move_21.Geometry)
pull_11 = PullPoint(Point=facen_8.Centers, Geometry=boundary_4, ClosestOnly=True)  # -> ClosestPoint, Distance
smaller_8 = SmallerThan(FirstNumber=pull_11.Distance, SecondNumber=Slider(0.1, range=0..0.1))  # -> SmallerThan, OrEqualTo
cullf_3 = CullFaces(Mesh=mjoin_4, Pattern=smaller_8.SmallerThan)

# ---- group: level 2 / lines diagonal v2
explode_10 = MeshExplode(Mesh=cullf_3, Interpolate=False)
demesh_5 = DeconstructMesh(Mesh=explode_10)  # -> Vertices, Faces, Colours, Normals
item_19 = ListItem(List=demesh_5.Vertices, Index=0, Wrap=True)  # -> Item, Item1, Item2, Item3
wbedges_3 = WeaverbirdsMeshEdges(MeshOrPolylines=cullf_3)
ln_9 = Line(StartPoint=item_19.Item, EndPoint=item_19.Item2)

# ---- group: level 0 (continued)
mjoin_5 = MeshJoin(Meshes=flatten(merge_14))

# ---- group: level 0 / create openings
facen_9 = FaceNormals(Mesh=mjoin_5)  # -> Centers, Normals
boundary_5 = BoundarySurfaces(Edges=move_18.Geometry)
pull_12 = PullPoint(Point=facen_9.Centers, Geometry=boundary_5, ClosestOnly=True)  # -> ClosestPoint, Distance
smaller_9 = SmallerThan(FirstNumber=pull_12.Distance, SecondNumber=Slider(4, range=0..4))  # -> SmallerThan, OrEqualTo
cullf_4 = CullFaces(Mesh=mjoin_5, Pattern=smaller_9.SmallerThan)

# ---- group: level 0 / lines horizontal
explode_11 = MeshExplode(Mesh=mjoin_5, Interpolate=False)
demesh_6 = DeconstructMesh(Mesh=explode_11)  # -> simplify(Vertices), Faces, Colours, Normals
item_20 = ListItem(List=demesh_6.Vertices, Index=0, Wrap=True)  # -> Item, Item1, Item2, Item3
ln_10 = Line(StartPoint=item_20.Item, EndPoint=item_20.Item1)  # -> simplify(Line)

# ----
# Building Facade
center_4 = Center(Geometry=cluster_3)  # -> Center, Dimension
avr_3 = Average(Input=center_4.Center)
scale_2 = Scale(Geometry=cluster_3, Center=avr_3, Factor=Slider(1.03, range=0..10))  # -> Geometry, Transform
center_5 = Center(Geometry=scale_2.Geometry)  # -> Center, Dimension

# ---- group: Solar Analysis
D = DateTime(Year=Slider(2020, range=0..10000), Month=Slider(12, range=0..100), Day=20, Hour=8, Minute=0, Second=0)
run = BooleanToggle(True)
L = Location(Latitude="41.3907372", Longitude="2.1745004")
times = DateTimes(DateTimeStart=637151040000000000, DateTimeEnd=D, MinuteInterval=Slider(10000, range=0..10000))
S = SolarAnalysisMeshFace(
    DateTime=times,
    Location=L,
    Mesh=scale_2.Geometry,
    ONOFF=run,
    TimeZone="(UTC+01:00)Amsterdam,Brussels,Paris,Prague,Rome,Stockholm,Vienna")  # -> Mesh, Point, Hour, Minutes

# ---- group: Join curves that follow the same angles
panel_27 = Panel("10")  # disabled
panel_28 = Panel("1")  # disabled

# ---- group: transversal lines / transversal structure / P_02
pt_5 = Point(demesh.Vertices)
flatten_2 = FlattenTree(Tree=pt_5, Path="{0}")
d2_2 = RemoteReceiver(d2)

# ---- group: transversal lines / transversal structure / P_01
pt_6 = Point(demesh.Vertices)
flatten_3 = FlattenTree(Tree=pt_6, Path="{0}")
d1_2 = RemoteReceiver(d1)

# ----
number_slider_18 = Slider(0.5, range=0..1)

pl = PlaneNormal(Origin=avr, ZAxis=avr_2)
number_slider_19 = Slider(742, range=0..1000)  # disabled
pl_2 = PlaneNormal(Origin=avr, ZAxis=avr_2)  # disabled

number_slider_20 = Slider(400, range=0..1000)  # disabled
button = Button()  # disabled
loop_start = LoopStart(N=number_slider_20, T=button, D0=pl_2)  # -> port, Counter, Data, Data_2; disabled
item_21 = ListItem(List=pl_2, Index=number_slider_19, Wrap=True)  # disabled
cplnori = ClosestPlaneOrientation(Reference=item_21, Targets=loop_start.Data, Axis=0)  # -> Closest, Index, AngleX, AngleY, AngleZ; disabled
cull_i = CullIndex(List=loop_start.Data, Indices=cplnori.Index, Wrap=True)  # disabled
loop_end = LoopEnd(
    port=loop_start.port,
    Exit=False,
    Data=cull_i,
    Data_2=cplnori.Closest,
    TimeOutVal=0,
    pausedState=False,
    state="Constant & Record")  # -> D0, flatten(D1); disabled
deplane = DeconstructPlane(Plane=loop_end.D1)  # -> Origin, XAxis, YAxis, ZAxis; disabled
cp_2 = ClosestPoint(Point=deplane.Origin, Cloud=pl_2)  # -> ClosestPoint, CPIndex, Distance; disabled
cull_i_2 = CullIndex(List=slstarmesh, Indices=cp_2.CPIndex, Wrap=True)  # disabled

item_22 = ListItem(List=slstarmesh, Index=cp_2.CPIndex, Wrap=True)  # disabled

series_5 = Series(Start=0.1, Step=0.1, Count=6)

matselect = MaterialSelectionKaramba3D(menu=[dropdown(4), dropdown(1)])  # disabled
panel_29 = Panel("5")  # disabled
cross_section = CrossSectionKaramba3D(
    FamilyNameOfCrossSection="DefaultCroSec",
    Material=matselect,
    Height_cm=panel_29,
    UpperFlangeWidth_cm=panel_29,
    LowerFlangeWidth_cm=panel_29,
    mode="Trapezoid")  # disabled

panel_30 = Panel("0,0,0")  # disabled

# ---- group: Solar Analysis
number_slider_21 = Slider(0.417, range=0..1)
demesh_7 = DeconstructMesh(Mesh=S.Mesh)  # -> Vertices, Faces, Colours, Normals
mesh_9 = Mesh(S.Mesh)
swatch = ColourSwatch(SwatchColor=RGB(255, 0, 0))
avr_4 = Average(Input=demesh_7.Vertices)  # -> flatten(ArithmeticMean)
avr_5 = Average(Input=demesh_7.Colours)  # -> flatten(ArithmeticMean)

test_color = TestColor(BaseListOfColors=avr_5, ColorToTestForInclusion=swatch, ColorThreshold=number_slider_21)
cull = CullPattern(List=avr_5, CullPattern=test_color)

index = ItemIndex(List=avr_5, Item=cull)
item_23 = ListItem(List=avr_4, Index=index, Wrap=True)

# ----
cps = ClosestPoints(Point=center_5.Center, Cloud=item_23, Count=Slider(1, range=0..1))  # -> ClosestPoint, CPIndex, flatten(Distance)

# ---- group: Attractor points and mesh subdivision
bnd_2 = Bounds(Numbers=cps.Distance)
remap_3 = RemapNumbers(Value=cps.Distance, Source=bnd_2, Target="0 to 3")  # -> Mapped, Clipped
round = Round(Number=remap_3.Mapped)  # -> Nearest, Floor, Ceiling
wbcatmullclark = WeaverbirdsCatmullClarkSubdivision(MeshCurves=graft(scale_2.Geometry), Level=graft(round.Nearest), SmoothNakedEdges=0)
wbfacepolys = WeaverbirdsFacePolylines(Mesh=wbcatmullclark)  # -> flatten(Polygons)

# ----
series_6 = Series(Start=0.03, Step=0.015, Count=4)

# ---- group: transversal lines / transversal structure / L0_L1
d0_2 = RemoteReceiver(d0)
d1_3 = RemoteReceiver(d1)
expression_7 = Expression(x=d1_3, y=d0_2, Expression="y-x")

# ---- group: transversal lines / transversal structure
d3_3 = RemoteReceiver(d3)

# ---- group: transversal lines / transversal structure / L0_L2
d2_3 = RemoteReceiver(d2)
d0_3 = RemoteReceiver(d0)
expression_8 = Expression(x=d2_3, y=d0_3, Expression="(y-x)+0.001")

# ---- group: transversal lines / transversal structure / L0_L3
d0_4 = RemoteReceiver(d0)
expression_9 = Expression(x=d3_3, y=d0_4, Expression="(y-x)+0.001")

# ---- group: Callout and Preview Individual Orientations
number_slider_22 = Slider(0, range=0..8)  # disabled
panel_31 = Panel("9")  # disabled
panel_32 = Panel("1")  # disabled
division = Division(A=number_slider_22, B=panel_31)  # disabled
panel_33 = Panel("-1")  # disabled
panel_34 = Panel("0.1")  # disabled
panel_35 = Panel("1")  # disabled
hsv = ColourHSV(Alpha=panel_35, Hue=division, Saturation=panel_35, Value=panel_35)  # disabled

# ----
swatch_2 = ColourSwatch(SwatchColor=RGB(255, 132, 0))
material = CreateMaterial(Diffuse=swatch_2, Specular=RGB(255, 255, 255), Emission=RGB(0, 0, 0), Transparency=Slider(0.5, range=0..1), Shine=0)
preview = CustomPreview(Material=material)

# ---- group: Window Frames (continued)
preview_2 = CustomPreview(Geometry=mjoin, Material=swatch_2)

# ---- group: level 0 (continued)
dupln = RemoveDuplicateLines(Lines=ln_10, Tolerance=0.01)
join_2 = JoinCurves(Curves=flatten(dupln), Preserve=False)

# ---- group: level 0 / Workaround for Overlapping Line Weirdness
disc = Discontinuity(Curve=join_2, Level=1)  # -> Points, Parameters
shatter = Shatter(Curve=graft(join_2), Parameters=disc.Parameters)  # -> simplify(Segments)
len_2 = Length(Curve=shatter)
sort_2 = SortList(Keys=len_2, ValuesA=shatter)  # -> Keys, ValuesA
item_24 = ListItem(List=sort_2.ValuesA, Index=0, Wrap=True)  # -> flatten(Item), flatten(Item1)
l0_points = RemoteSender(item_24.Item1)

# ---- group: transversal lines / transversal structure / L0_L3 (continued)
l0_points_2 = RemoteReceiver(l0_points)
pull_13 = PullPoint(Point=flatten(pt_4), Geometry=l0_points_2, ClosestOnly=True)  # -> ClosestPoint, Distance
ln_11 = Line(StartPoint=pull_13.ClosestPoint, EndPoint=pt_4)
smaller_10 = SmallerThan(FirstNumber=ln_11, SecondNumber=expression_9)  # -> SmallerThan, OrEqualTo
dispatch_7 = Dispatch(List=ln_11, DispatchPattern=smaller_10.OrEqualTo)  # -> ListA, ListB
geo_2 = Geometry(dispatch_7.ListA)

# ----
crv_9 = Curve(reparameterize(item_24.Item1))

# ---- group: level 0 (continued)
midpt_2 = CurveMiddle(Curve=crv_9)
len_3 = Length(Curve=crv_9)
frame_3 = CurveFrame(Curve=crv_9, Parameter="0")
frame_4 = CurveFrame(Curve=crv_9, Parameter="0.5")
pl_origin_2 = PlaneOrigin(Base=frame_4, Origin=midpt_2)
box_3 = DomainBox(Base=frame_3, X=len_3, Y=width_5, Z=height_5)

# ----
l0_points_3 = RemoteReceiver(l0_points)  # disabled
shatter_2 = Shatter(Curve=reparameterize(l0_points_3), Parameters=panel_21)  # -> flatten(Segments); disabled

# ---- group: transversal lines / transversal structure / L0_L2 (continued)
l0_points_4 = RemoteReceiver(l0_points)

# ---- group: transversal lines / transversal structure / L0_L1 (continued)
l0_points_5 = RemoteReceiver(l0_points)

# ---- group: level 1 (continued)
ln_12 = Line(StartPoint=item_18.Item1, EndPoint=item_18.Item3)

# ---- group: level 1 / path
merge_16 = Merge(Data1=ln_8, Data2=ln_12, Data3=wbedges_2)  # -> flatten(Result)
shortwalk_2 = ShortestWalk(Curves=merge_16, WantedPath=ln_3)  # -> ShortestWalk, Succession, Direction, Length
explode_12 = Explode(Curve=shortwalk_2.ShortestWalk, Recursive=True)  # -> Segments, Vertices

# ----
cluster_join_curves_2 = ClusterJoinCurves(crv=explode_12.Segments)

# ---- group: level 1 (continued)
midpt_3 = CurveMiddle(Curve=cluster_join_curves_2)
len_4 = Length(Curve=cluster_join_curves_2)
l1_points = RemoteSender(cluster_join_curves_2)
frame_5 = CurveFrame(Curve=cluster_join_curves_2, Parameter=midpt_3)
frame_6 = CurveFrame(Curve=cluster_join_curves_2, Parameter="0")
pl_origin_3 = PlaneOrigin(Base=frame_5, Origin=midpt_3)
box_4 = DomainBox(Base=frame_6, X=len_4, Y=width_2, Z=height_2)

# ---- group: transversal lines / transversal structure / P_01 (continued)
l1_points_2 = RemoteReceiver(l1_points)
pull_14 = PullPoint(Point=flatten_3, Geometry=l1_points_2, ClosestOnly=True)  # -> ClosestPoint, Distance
smaller_11 = SmallerThan(FirstNumber=pull_14.Distance, SecondNumber=expr("-(x)", d1_2))  # -> SmallerThan, OrEqualTo
dispatch_8 = Dispatch(List=pull_14.ClosestPoint, DispatchPattern=smaller_11.OrEqualTo)  # -> ListA, ListB
pt_7 = Point(dispatch_8.ListA)

# ---- group: transversal lines / transversal structure / L0_L1 (continued)
pull_15 = PullPoint(Point=flatten(pt_7), Geometry=l0_points_5, ClosestOnly=True)  # -> ClosestPoint, Distance
ln_13 = Line(StartPoint=pull_15.ClosestPoint, EndPoint=pt_7)
smaller_12 = SmallerThan(FirstNumber=ln_13, SecondNumber=expression_7)  # -> SmallerThan, OrEqualTo
dispatch_9 = Dispatch(List=ln_13, DispatchPattern=smaller_12.OrEqualTo)  # -> ListA, ListB
geo_3 = Geometry(dispatch_9.ListA)

# ----
l1_points_3 = RemoteReceiver(l1_points)  # disabled

# ---- group: level 2 (continued)
ln_14 = Line(StartPoint=item_19.Item1, EndPoint=item_19.Item3)
merge_17 = Merge(Data1=ln_9, Data2=ln_14, Data3=wbedges_3)  # -> flatten(Result)
shortwalk_3 = ShortestWalk(Curves=merge_17, WantedPath=ln_4)  # -> ShortestWalk, Succession, Direction, Length
explode_13 = Explode(Curve=shortwalk_3.ShortestWalk, Recursive=True)  # -> Segments, Vertices

# ----
cluster_join_curves_3 = ClusterJoinCurves(crv=explode_13.Segments)

# ---- group: level 2 (continued)
l2_points = RemoteSender(cluster_join_curves_3)
midpt_4 = CurveMiddle(Curve=cluster_join_curves_3)
len_5 = Length(Curve=cluster_join_curves_3)
frame_7 = CurveFrame(Curve=cluster_join_curves_3, Parameter=midpt_4)
frame_8 = CurveFrame(Curve=cluster_join_curves_3, Parameter="0")
pl_origin_4 = PlaneOrigin(Base=frame_7, Origin=midpt_4)
box_5 = DomainBox(Base=frame_8, X=len_5, Y=width_3, Z=height_3)

# ----
l2_points_2 = RemoteReceiver(l2_points)  # disabled
merge_18 = Merge(Data2=shatter_2, Data3=l1_points_3, Data4=l2_points_2, Data5=l3_points_3)  # disabled
scale_3 = Scale(Geometry=merge_18, Center=Point(0, 0, 0), Factor=panel_22)  # -> flatten(Geometry), Transform; disabled
crv_10 = Curve(scale_3.Geometry)  # disabled
end = EndPoints(Curve=crv_10)  # -> Start, End; disabled
ln_15 = Line(StartPoint=end.Start, EndPoint=end.End)  # disabled
llinter = LineLineIntersectionKaramba3D(Line=ln_15, LimitDistance_m=panel_23)  # -> IntersectionPoints, flatten(LineSubSegements); disabled

merge_19 = Merge(Data2=l0_points_3, Data3=l1_points_3, Data4=l2_points_2, Data5=l3_points_3)  # -> flatten(Result); disabled
len_6 = Length(Curve=merge_19)  # disabled
curve_trimmed_elements = RemoteSender(merge_19)  # disabled
num_design_lengths = RemoteSender(len_6)  # disabled

# ---- group: Attempts to cull unsupported elements (continued)
end_2 = EndPoints(Curve=llinter.LineSubSegements)  # -> Start, End; disabled
pdecon_2 = Deconstruct(Point=end_2.Start)  # -> XComponent, YComponent, ZComponent; disabled
pdecon_3 = Deconstruct(Point=end_2.End)  # -> XComponent, YComponent, ZComponent; disabled
eval_2 = Evaluate(F=panel_24, x=pdecon_2.XComponent)  # disabled
eval_3 = Evaluate(F=panel_24, x=pdecon_2.YComponent)  # disabled
eval_4 = Evaluate(F=panel_24, x=pdecon_2.ZComponent)  # disabled
eval_5 = Evaluate(F=panel_24, x=pdecon_3.XComponent)  # disabled
eval_6 = Evaluate(F=panel_24, x=pdecon_3.YComponent)  # disabled
eval_7 = Evaluate(F=panel_24, x=pdecon_3.ZComponent)  # disabled
pt_8 = ConstructPoint(XCoordinate=eval_2, YCoordinate=eval_3, ZCoordinate=eval_4)  # disabled
pt_9 = ConstructPoint(XCoordinate=eval_5, YCoordinate=eval_6, ZCoordinate=eval_7)  # disabled
merge_20 = Merge(Data1=pt_8, Data2=pt_9)  # disabled
mindex_5 = MemberIndex(Set=merge_20, Member=pt_8)  # -> Index, Count; disabled
mindex_6 = MemberIndex(Set=merge_20, Member=pt_9)  # -> Index, Count; disabled
larger_2 = LargerThan(FirstNumber=mindex_5.Count, SecondNumber=panel_25)  # -> LargerThan, OrEqualTo; disabled
larger_3 = LargerThan(FirstNumber=mindex_6.Count, SecondNumber=panel_25)  # -> LargerThan, OrEqualTo; disabled
and = GateAnd(A=larger_2.LargerThan, B=larger_3.LargerThan)  # disabled
dispatch_10 = Dispatch(List=llinter.LineSubSegements, DispatchPattern=and)  # -> ListA, ListB; disabled
crv_11 = Curve(dispatch_10.ListA)  # disabled

# ----
crv_12 = Curve(llinter.LineSubSegements)  # disabled

# ---- group: Find Suport Points (continued)
end_3 = EndPoints(Curve=crv_12)  # -> Start, End; disabled
merge_21 = Merge(Data1=end_3.Start, Data2=end_3.End)  # -> flatten(Result); disabled
pdecon_4 = Deconstruct(Point=merge_21)  # -> XComponent, YComponent, ZComponent; disabled
eval_8 = EvaluateCurve(Curve=reparameterize(crv_12), Parameter=panel_26)  # -> Point, Tangent, Angle; disabled
bnd_3 = Bounds(Numbers=pdecon_4.ZComponent)  # disabled
end_4 = EndPoints(Curve=crv_12)  # -> Start, End; disabled
pdecon_5 = Deconstruct(Point=eval_8.Point)  # -> XComponent, YComponent, ZComponent; disabled
dedomain_8 = DeconstructDomain(Domain=bnd_3)  # -> Start, End; disabled
bnd_4 = Bounds(Numbers=pdecon_5.YComponent)  # disabled
merge_22 = Merge(Data1=graft(end_4.Start), Data2=graft(end_4.End))  # disabled
similar = Similarity(FirstNumber=pdecon_4.ZComponent, SecondNumber=dedomain_8.End, Threshold=0.1)  # -> Similarity, AbsoluteDifference; disabled
similar_2 = Similarity(FirstNumber=pdecon_4.ZComponent, SecondNumber=dedomain_8.Start, Threshold=0.1)  # -> Similarity, AbsoluteDifference; disabled
dedomain_9 = DeconstructDomain(Domain=bnd_4)  # -> Start, End; disabled
flip_3 = FlipMatrix(Data=merge_22)  # disabled
dispatch_11 = Dispatch(List=merge_21, DispatchPattern=similar.Similarity)  # -> ListA, ListB; disabled
dispatch_12 = Dispatch(List=merge_21, DispatchPattern=similar_2.Similarity)  # -> ListA, ListB; disabled
similar_3 = Similarity(FirstNumber=pdecon_5.YComponent, SecondNumber=dedomain_9.End, Threshold=0.1)  # -> Similarity, AbsoluteDifference; disabled
dispatch_13 = Dispatch(List=flip_3, DispatchPattern=similar_3.Similarity)  # -> ListA, ListB; disabled
merge_23 = Merge(Data1=flatten(dispatch_13.ListA), Data2=dispatch_11.ListA, Data3=dispatch_12.ListA)  # -> flatten(Result); disabled

# ---- group: transversal lines / transversal structure / P_02 (continued)
l2_points_3 = RemoteReceiver(l2_points)
pull_16 = PullPoint(Point=flatten_2, Geometry=l2_points_3, ClosestOnly=True)  # -> ClosestPoint, Distance
smaller_13 = SmallerThan(FirstNumber=pull_16.Distance, SecondNumber=expr("-x+0.001", d2_2))  # -> SmallerThan, OrEqualTo
dispatch_14 = Dispatch(List=pull_16.ClosestPoint, DispatchPattern=smaller_13.OrEqualTo)  # -> ListA, ListB
pt_10 = Point(dispatch_14.ListA)

# ----
pt_11 = Point(merge_23)  # disabled
supp = SupportKaramba3D(PosInd=pt_11, menu=[buttons(on, on, on, on, on, on)])  # disabled
linetobeam = LineToBeamKaramba3D(Line=flatten(crv_12), CrossSection=cross_section, New=True, Remove=True, LimitDistance_m=0.005)  # -> Element, Points, Info; disabled
assemble = AssembleModelKaramba3D(Elem=flatten(linetobeam.Element), Support=flatten(supp), LimitDistance_m=0.005)  # -> Model, Info, Mass_kg, CenterOfGravity; disabled
analyze = AnalyzeKaramba3D(Model=assemble.Model)  # -> CalculatedModel, MaximumDisplacement_cm, ResultingForceOfGravity_kN, ElasticEnergy_kNm; disabled
modelview = ModelViewKaramba3D(Model=analyze.CalculatedModel, ResultFactors=1, ResultCase=-1)  # -> Model, DeformedMesh, DeformedAxes, DeformedModel; disabled
num_max_displacement = RemoteSender(analyze.MaximumDisplacement_cm)  # disabled
beamview = BeamViewKaramba3D(Model=modelview.Model)  # -> Model, MeshesOfRenderedBeams, DeformedBeamAxes, LegendColors, LegendTags; disabled
legend = Legend(Colour=beamview.LegendColors, Tags=beamview.LegendTags, LegendType=1)  # disabled

# ---- group: transversal lines / transversal structure / L0_L2 (continued)
pull_17 = PullPoint(Point=flatten(pt_10), Geometry=l0_points_4, ClosestOnly=True)  # -> ClosestPoint, Distance
ln_16 = Line(StartPoint=pull_17.ClosestPoint, EndPoint=pt_10)
smaller_14 = SmallerThan(FirstNumber=ln_16, SecondNumber=expression_8)  # -> SmallerThan, OrEqualTo
dispatch_15 = Dispatch(List=ln_16, DispatchPattern=smaller_14.OrEqualTo)  # -> ListA, ListB
geo_4 = Geometry(dispatch_15.ListA)

# ---- group: transversal lines / transversal structure (continued)
merge_24 = Merge(Data1=geo_3, Data2=geo_4, Data3=geo_2)

# ---- group: transversal lines
dupln_2 = RemoveDuplicateLines(Lines=merge_24, Tolerance=0.01)
line_support = RemoteSender(dupln_2)
midpt_5 = CurveMiddle(Curve=dupln_2)
len_7 = Length(Curve=dupln_2)
frame_9 = CurveFrame(Curve=dupln_2, Parameter=midpt_5)
height_6 = RemoteReceiver(height)
width_6 = RemoteReceiver(width)
frame_10 = CurveFrame(Curve=dupln_2, Parameter="0")
pl_origin_5 = PlaneOrigin(Base=frame_9, Origin=midpt_5)
box_6 = DomainBox(Base=frame_10, X=len_7, Y=width_6, Z=height_6)

# ----
merge_25 = Merge(Data1=pl_origin_2, Data2=pl_origin_3, Data3=pl_origin_4, Data4=pl_origin, Data5=pl_origin_5)  # -> flatten(Result)
plane = RemoteSender(merge_25)

X = UnitX(Factor=1)
move_22 = Move(Geometry=box_6, Motion=expr("x*2", X))  # -> Geometry, Transform
preview_3 = CustomPreview(Geometry=ln_2, Material=ColourSwatch(SwatchColor=RGBA(0, 0, 0, 185)))
preview_4 = CustomPreview(Geometry=box_3, Material=ColourSwatch(SwatchColor=RGB(255, 173, 255)))
preview_5 = CustomPreview(Geometry=box_4, Material=ColourSwatch(SwatchColor=RGB(181, 111, 255)))
preview_6 = CustomPreview(Geometry=box_5, Material=ColourSwatch(SwatchColor=RGB(76, 109, 255)))
preview_7 = CustomPreview(Geometry=box_2, Material=ColourSwatch(SwatchColor=RGB(41, 197, 255)))
preview_8 = CustomPreview(Geometry=move_22.Geometry, Material=ColourSwatch(SwatchColor=RGB(41, 197, 255)))

center_6 = Center(Geometry=wbfacepolys)  # -> Center, Dimension
cps_2 = ClosestPoints(Point=center_6.Center, Cloud=item_23, Count=Slider(1, range=0..1))  # -> ClosestPoint, CPIndex, flatten(Distance)

# ---- group: Create patterns for growth
sort_3 = SortList(Keys=cps_2.Distance, ValuesA=wbfacepolys)  # -> Keys, ValuesA
series_7 = Series(Start=0, Step=Slider(20, range=0..20), Count=Slider(300, range=0..1000))

# ----
rev = ReverseList(List=sort_3.ValuesA)
cluster_4 = Cluster_2(C=rev)

# ---- group: Create patterns for growth (continued)
item_25 = ListItem(List=rev, Index=series_7, Wrap=True)

# ---- group: Extrude proportions
explode_14 = Explode(Curve=rev, Recursive=True)  # -> Segments, Vertices
tstat_2 = TreeStatistics(Tree=explode_14.Segments)  # -> Paths, Length, Count
item_26 = ListItem(List=tstat_2.Paths, Index=series_7, Wrap=True)
item_27 = TreeItem(Tree=explode_14.Segments, Path=tstat_2.Paths, Index=0, Wrap=True)
len_8 = Length(Curve=item_27)

# ----
offmsh = OffsetMesh(Mesh=cluster_4, Distance=len_8, BothSides=False, CreateSolid=True)  # -> flatten(Offset)
wbfacepolys_2 = WeaverbirdsFacePolylines(Mesh=offmsh)
dash = DashPattern(Curve=wbfacepolys_2, Pattern=Slider(0.05, range=0..0.1))  # -> Dashes, Gaps

# ----
# Boxes Strategy
flatten_4 = FlattenTree(Tree=offmsh, Path="{0}")
graft = GraftTree(Tree=flatten_4, IncludeEmptyLists=True, IncludeNullItems=True)
voxel = Voxel(Points=graft, X=1, Y=1, Z=1)  # -> simplify(Voxels); disabled
wbfacepolys_3 = WeaverbirdsFacePolylines(Mesh=graft)
explode_15 = MeshExplode(Mesh=graft, Interpolate=False)
dash_2 = DashPattern(Curve=wbfacepolys_3, Pattern=Slider(0.04, range=0..0.1))  # -> Dashes, Gaps; disabled
center_7 = Center(Geometry=explode_15)  # -> Center, Dimension

cluster_5 = Cluster_4(T_3=chars.Result, T=center_7.Center, T_2=chars.Result)
item_28 = ListItem(List=center_7.Center, Index=simplify(cluster_5), Wrap=True)
pline = PolyLine(Vertices=item_28, Closed=False)  # -> flatten(Polyline)
explode_16 = Explode(Curve=pline, Recursive=True)  # -> flatten(Segments), Vertices
crv_13 = Curve(explode_16.Segments)

# ---- group: Join curves that follow the same angles (continued)
end_5 = EndPoints(Curve=crv_13)  # -> Start, End; disabled
vec2pt = Vector2Pt(PointA=end_5.Start, PointB=end_5.End, Unitize=panel_28)  # -> Vector, Length; disabled
multiplication_3 = Multiplication(A=vec2pt.Vector, B=panel_27)  # disabled
devec = DeconstructVector(Vector=multiplication_3)  # -> XComponent, YComponent, ZComponent; disabled
int_3 = Integer(devec.XComponent)  # disabled
int_4 = Integer(devec.YComponent)  # disabled
int_5 = Integer(devec.ZComponent)  # disabled
vec_8 = VectorXYZ(XComponent=int_3, YComponent=int_4, ZComponent=int_5)  # -> Vector, Length; disabled
python_2 = GhPythonScript(vectors=vec_8.Vector)  # -> out, output; inputs vectors: list; disabled; same code as python
cset_2 = CreateSet(List=python_2.output)  # -> Set, Map; disabled
mindex_7 = MemberIndex(Set=python_2.output, Member=cset_2.Set)  # -> Index, Count; disabled
item_29 = ListItem(List=crv_13, Index=mindex_7.Index, Wrap=True)  # disabled
join_3 = JoinCurves(Curves=simplify(item_29), Preserve=False)  # disabled
crv_14 = Curve(flatten(join_3))  # disabled

# ----
vdis = VectorDisplay(Anchor=panel_30, Vector=cset_2.Set)  # disabled

# ---- group: Callout and Preview Individual Orientations (continued)
crv_15 = Curve(crv_14)  # disabled
simplify = SimplifyCurve(Curve=crv_15)  # -> Curve, Simplified; disabled
tstat_3 = TreeStatistics(Tree=simplify.Curve)  # -> Paths, Length, Count; disabled
addition = Addition(A=tstat_3.Count, B=panel_32)  # disabled
branch_2 = TreeBranch(Tree=simplify(simplify.Curve), Path=number_slider_22, MaintainPaths=True)  # disabled
range = Range(Domain=Domain(0, 1), Steps=tstat_3.Count)  # disabled
split_5 = SplitList(List=range, Index=tstat_3.Count)  # -> ListA, ListB; disabled
mpipe = MeshPipe(Polylines=branch_2, NumberOfSides=4, Tolerance=0.1, Radius=panel_34, Cap=False, Join=False)  # disabled
preview_9 = CustomPreview(Geometry=simplify(mpipe), Material=simplify(graft(hsv)))  # disabled

# ---- group: Growth Algorithm
_3d_aggregation = _3DAggregation(BaseMesh=offmsh, Iterations=Slider(1, range=0..10), Obstacles=offmsh, BranchCount=Slider(3, range=0..10))  # -> AggregatedMeshes, MeshCount; disabled
explode_17 = MeshExplode(Mesh=offmsh, Interpolate=False)
center_8 = Center(Geometry=explode_17)  # -> Center, Dimension

# ----
len_9 = Length(Curve=crv_13)
sort_4 = SortList(Keys=len_9, ValuesA=crv_13)  # -> Keys, ValuesA
len_10 = Length(Curve=sort_4.ValuesA)
smaller_15 = SmallerThan(FirstNumber=len_10, SecondNumber=Slider(1.858, range=0..3))  # -> SmallerThan, OrEqualTo
cull_2 = CullPattern(List=sort_4.ValuesA, CullPattern=smaller_15.SmallerThan)

lng_2 = ListLength(List=sort_4.ValuesA)
repeat_3 = RepeatData(Data=series_5, Length=lng_2)
randomize = RandomizeNumbers(Number=repeat_3, Ratio=0.2)
roundd = RoundToDecimalPlace(NumberX=randomize, DecimalPlace="2", RoundType=0)  # -> Rounded, Difference
jitter_3 = Jitter(List=roundd.Rounded, Jitter=1, Seed=2)  # -> Values, Indices
sort_5 = SortList(Keys=jitter_3.Values)  # -> Keys, ValuesA

multiplication_4 = Multiplication(A=sort_4.Keys, B=sort_5.Keys)
ext = ExtendCurve(Curve=cull_2, Type=0, Start=multiplication_4, End=multiplication_4)

lng_3 = ListLength(List=ext)
repeat_4 = RepeatData(Data=series_6, Length=lng_3)
randomize_2 = RandomizeNumbers(Number=repeat_4, Ratio=0.2)
roundd_2 = RoundToDecimalPlace(NumberX=randomize_2, DecimalPlace="2", RoundType=0)  # -> Rounded, Difference
sort_6 = SortList(Keys=roundd_2.Rounded)  # -> Keys, ValuesA

dom_2 = ConstructDomain(DomainStart=0, DomainEnd=sort_6.Keys)
planesrf = PlaneSurface(Plane=PlaneXY(0, 0, 0), XSize=dom_2, YSize=dom_2)
msweep_2 = MeshSweep(RailCurve=ext, SectionCurve=planesrf, Accuracy=0.2, Cap=True, Autoorient=True, Rotation=0)
wbfacepolys_4 = WeaverbirdsFacePolylines(Mesh=msweep_2)
previewlw = CustomPreviewLineweights(Geometry=wbfacepolys_4, Shader=ColourSwatch(SwatchColor=RGB(0, 0, 0)), Absolute=False)

center_9 = Center(Geometry=msweep_2)  # -> Center, Dimension
featurets_2 = FeatureTensorSet(Feature0=center_9.Center)
kmeans_2 = KMeansClustering(Data=featurets_2, Clusters=Slider(6, range=0..100), Iterations=Slider(20, range=0..100), Seed=123)  # -> simplify(Clusters), Indices
detset_3 = DeconstructTensorSet(TensorSet=kmeans_2.Clusters)
tstat_4 = TreeStatistics(Tree=detset_3)  # -> Paths, Length, Count
item_30 = ListItem(List=tstat_4.Paths, Index=Slider(5, range=0..20), Wrap=True)
branch_3 = TreeBranch(Tree=detset_3, Path=item_30, MaintainPaths=True)
detensor_3 = DeconstructTensor(Tensor=branch_3)
item_31 = ListItem(List=detensor_3, Index=0, Wrap=True)  # -> flatten(Item), flatten(Item1), flatten(Item2)
pt_12 = ConstructPoint(XCoordinate=item_31.Item, YCoordinate=item_31.Item1, ZCoordinate=item_31.Item2)
mindex_8 = MemberIndex(Set=center_9.Center, Member=pt_12)  # -> flatten(Index), Count
item_32 = ListItem(List=msweep_2, Index=mindex_8.Index, Wrap=True)
item_33 = ListItem(List=ext, Index=mindex_8.Index, Wrap=True)
meshes = RemoteSender(item_32)
part_4 = RemoteSender(item_33)

lng_4 = ListLength(List=msweep_2)
division_2 = Division(A=lng_4, B=Slider(3, range=0..100))
partition = PartitionList(List=msweep_2, Size=division_2)  # -> simplify(Chunks)
bang = ExplodeTree(Data=partition)  # -> Branch0, Branch1, Branch2
part_1 = RemoteSender(bang.Branch0)
part_2 = RemoteSender(bang.Branch1)
part_3 = RemoteSender(bang.Branch2)

part_4_2 = RemoteReceiver(part_4)

len_11 = Length(Curve=part_4_2)  # -> flatten(Length)
eval_9 = EvaluateCurve(Curve=part_4_2, Parameter="0.5")  # -> Point, Tangent, Angle
xy_2 = XYPlane(Origin=Point(0, 0, 0))
length = RemoteSender(len_11)
flippln = FlipPlane(Plane=xy_2, FlipX=False, FlipY=False, FlipZ=True)  # -> Flipped, R
tstat_5 = TreeStatistics(Tree=part_4_2)  # -> Paths, Length, Count
merge_26 = Merge(Data1=xy_2, Data2=flippln.Flipped)
repeat_5 = RepeatData(Data=merge_26, Length=tstat_5.Count)
pl_origin_6 = PlaneOrigin(Base=simplify(graft(repeat_5)), Origin=eval_9.Point)
plane_2 = RemoteSender(pl_origin_6)

curve_trimmed_elements_2 = RemoteSender(part_4_2)
length_2 = RemoteReceiver(length)

number_slider_23 = Slider(5, range=0..100)
plane_3 = RemoteReceiver(flatten([plane_2, plane]))
items_x_4 = RemoteReceiver(items_x)
python_3 = GhPythonScript(design=length_2, database=items_x_4, planes=plane_3, tolerance=number_slider_23)  # -> out, cuts, output_lengths, output_planes, output_dbids, output_types, output_unmatched_count, design_ids; inputs design: list, database: list, planes: list of Plane
# ---------- python_3: Python ----------
# INPUTS
# design : dimensions of pieces described in design
# database : dimensions of pieces in database slice
# planes : center planes associated with design pieces
# tolerance : percentage a piece can be larger than design without needing to be cut


import rhinoscriptsyntax as rs
import ghpythonlib.components as gh

import bisect
import collections
import time

# === DECLARATIONS ===

output_lengths = []
output_planes = []
output_dbids = []
output_types = []


cuts = 0 # number of cuts

largest_db_value = 0

TYPE_FOUND = 0
TYPE_CUT = 1
TYPE_MISSING = 2

kerf_width = 0.003

# === DEFINITIONS ===

def millis():
    return int(round(time.time() * 1000))
    
def reverse_insort(a, x, concurrent_list = None, concurrent_item = None):
    """Insert item x in list a, and keep it reverse-sorted assuming a
    is reverse-sorted.

    If x is already in a, insert it to the right of the rightmost x.
    Doesn't use lo and hi arguments
    """
    lo = 0
    hi = len(a)
        
    while lo < hi:
        mid = (lo+hi)//2
        if x > a[mid]: 
            hi = mid
        else: 
            lo = mid+1
    a.insert(lo, x)
    if concurrent_list is not None:
        concurrent_list.insert(lo,concurrent_item)



# === MAIN SCRIPT ===

# Time at start of execution
time_start = millis()

# Sort the design elements by length, and reverse to put largest first
design_ids = gh.Series(0,1,len(design))
design,design_ids = gh.SortList(design,design_ids)
planes = gh.ListItem(planes,design_ids,True)
design.reverse()
planes.reverse()
design_ids.reverse()

# Do the same for the database, and create a listing of the original ids
database_ids = gh.Series(0,1,len(database))
database,database_ids = gh.SortList(database,database_ids)
database.reverse()
database_ids.reverse()

# Start largest available element
largest_db_value = database[0]

# Record time taken for sorting
time_sort = millis()
print("Sort time : %s" % (time_sort - time_start))



for design_id,design_length in enumerate(design):
    minimum_id = -1
    minimum = 10000000000
    minimum_id_to_cut = -1
    minimum_to_cut = 10000000000
    design_plus_tolerance = design_length + (design_length*(tolerance/100.))
    # If the item is bigger than the dataset, build of two parts
    if design_plus_tolerance > largest_db_value:
        new_length = design_length / 2
        #continue
    for item_id,item_length in enumerate(database):
        if item_length >= design_length:
            if item_length <= design_plus_tolerance:
                minimum = item_length
                minimum_id = item_id
            else:
                minimum_to_cut = item_length
                minimum_id_to_cut = item_id
        # If smaller, we're now below the usable range
        else:
           break

    # When it can't find any usable piece
    if minimum_id == -1 and minimum_id_to_cut == -1:
        output_lengths.append(design_length)
        output_types.append(TYPE_MISSING)
        output_dbids.append(-1)

    # When a cut happens
    elif minimum_id == -1:
        db_id = database_ids[minimum_id_to_cut]
        del database[minimum_id_to_cut]
        del database_ids[minimum_id_to_cut]
        
        output_lengths.append(design_length)
        output_types.append(TYPE_CUT)
        output_dbids.append(db_id)
        cutoff_length = minimum_to_cut - design_length - kerf_width
        reverse_insort(database,cutoff_length,database_ids,db_id)
        cuts = cuts + 1

    # When it finds a usable piece that doens't need cuts
    else:
        db_id = database_ids[minimum_id]
        del database[minimum_id]
        del database_ids[minimum_id]
        output_lengths.append(minimum)
        output_types.append(TYPE_FOUND)
        output_dbids.append(db_id)
        
    output_planes.append(planes[design_id])
    
time_end = millis()

output_unmatched_count = output_types.count(2)

print("Match time : %s" % (time_end - time_sort))

print("Fully Matched Items: %s" % output_types.count(0))
print("Matches After Cut: %s" % output_types.count(1))
print("Unmatched Items: %s" % output_unmatched_count)
print("Unused Database Items : %s" % len(database))
# ---------- end python_3 ----------
int_output_unmatched_count = RemoteSender(python_3.output_unmatched_count)
num_output_lengths = RemoteSender(python_3.output_lengths)
num_output_planes = RemoteSender(python_3.output_planes)
int_output_dbids = RemoteSender(python_3.output_dbids)
int_output_types = RemoteSender(python_3.output_types)
int_cut_count = RemoteSender(python_3.cuts)

bar_graph = BarGraph(length_2, BarColor=RGB(255, 0, 90))
bar_graph_2 = BarGraph(items_x_4, BarColor=RGB(255, 0, 90))
panel_36 = Panel(python_3.out)
bar_graph_3 = BarGraph(python_3.output_types, BarColor=RGB(255, 0, 90))
pie = PieChart(python_3.output_types)
found_item = RemoteSender(python_3.output_dbids)
length_3 = RemoteReceiver(length)

# ----
# Optimization
int_output_unmatched_count_2 = RemoteReceiver(int_output_unmatched_count)
num_maximum_distance_3 = RemoteReceiver(num_maximum_distance)
num_total_displacement_2 = RemoteReceiver(num_total_displacement)  # disabled
num_max_utilization_2 = RemoteReceiver(num_max_utilization)  # disabled
int_output_dbids_2 = RemoteReceiver(int_output_dbids)
items_distance_3 = RemoteReceiver(items_distance)
int_cut_count_2 = RemoteReceiver(int_cut_count)
item_34 = ListItem(List=items_distance_3, Index=int_output_dbids_2, Wrap="0")
lng_5 = ListLength(List=length_3)
avr_6 = Average(Input=item_34)
total_displacement = Panel(num_total_displacement_2)  # disabled
max_utilization = Panel(num_max_utilization_2)  # disabled
panel_37 = Panel(int_output_unmatched_count_2)
panel_38 = Panel(lng_5)
cuts = Panel(int_cut_count_2)
max_cuts = Panel(lng_5)
cost = Panel(avr_6)
max_cost = Panel(num_maximum_distance_3)
division_3 = Division(A=panel_37, B=panel_38)
division_4 = Division(A=cuts, B=max_cuts)
division_5 = Division(A=cost, B=max_cost)
num_9 = Number(max_utilization)  # disabled
num_10 = Number(total_displacement)  # disabled
panel_39 = Panel("""0
1
0
0
0""")
item_35 = ListItem(List=panel_39, Index=0, Wrap=True)  # -> Item, Item1, Item2, Item3, Item4
expression_10 = Expression(
    miss=division_3,
    cut=division_4,
    cost=division_5,
    w1=item_35.Item,
    w2=item_35.Item1,
    w3=item_35.Item2,
    w4=item_35.Item3,
    w5=item_35.Item4,
    Expression="(w1*miss)+(w2*cut)+(w3*cost)")
num_fitness = RemoteSender(expression_10)

# ----
# Element Matching
num_fitness_2 = RemoteReceiver(num_fitness)
galapagos = Galapagos()
num_11 = Number(num_fitness_2)
panel_40 = Panel(num_11)

# ---- group: Tracking Parameters
recg = DataRecorder(division_3, DataLimit=50, RecordData=True)
recg_2 = DataRecorder(division_4, DataLimit=50, RecordData=True)
recg_3 = DataRecorder(division_5, DataLimit=50, RecordData=True)
recg_4 = DataRecorder(num_9, DataLimit=50, RecordData=True)  # disabled
recg_5 = DataRecorder(num_10, DataLimit=50, RecordData=True)  # disabled
c_rec_ctrl = CSharpScript(clean=Button())  # -> out, pause_state; inputs clean: Boolean, pause: Boolean
# ---------- c_rec_ctrl: C# usings ----------
using System.IO;
using System.Linq;
using System.Data;
using System.Drawing;
using System.Reflection;
using System.Windows.Forms;
using System.Xml;
using System.Xml.Linq;
using System.Runtime.InteropServices;

using Rhino.DocObjects;
using Rhino.Collections;
using GH_IO;
using GH_IO.Serialization;
# ---------- c_rec_ctrl: C# ----------
    //iterate through all the objects of the grashopper document;
    foreach (object obj in GrasshopperDocument.Objects) {
      //check only for the GH_DataRecorder components
      if (obj is Grasshopper.Kernel.Special.GH_DataRecorder) {
        //cast the obj into GH_DataRecorder wrapper class to be able to access its methods
        Grasshopper.Kernel.Special.GH_DataRecorder dataDestroy = (Grasshopper.Kernel.Special.GH_DataRecorder) obj;

        if (dataDestroy.NickName == "RecG") {
          //store the recording state of the component in a temp boolean
          bool recState = dataDestroy.RecordData;

          if(clean) {
            //clean the data and reset the recorder component
            dataDestroy.DestroyRecordedData();
            dataDestroy.ExpireSolution(true);
          }
          if(pause) {
            dataDestroy.RecordData = !recState;
            recState = dataDestroy.RecordData;
          }
          pause_state = recState;
        }

      }
    }
# ---------- end c_rec_ctrl ----------
graph = QuickGraph(recg, SortOrder=0)
graph_2 = QuickGraph(recg_2, SortOrder=0)
graph_3 = QuickGraph(recg_3, SortOrder=0)
graph_4 = QuickGraph(recg_4, SortOrder=0)  # disabled
graph_5 = QuickGraph(recg_5, SortOrder=0)  # disabled

# ----
int_output_dbids_3 = RemoteReceiver(int_output_dbids)
# Design visualization
meshes_2 = RemoteReceiver(meshes)
center_10 = Center(Geometry=meshes_2)  # -> Center, Dimension
rev_2 = ReverseList(List=meshes_2)
item_36 = ListItem(List=items_y_2, Index=int_output_dbids_3, Wrap=True)
num_output_lengths_2 = RemoteReceiver(num_output_lengths)
cluster_6 = Cluster_5(G=rev_2, M=rev_2, B=pt_2, X=item_36, Y=item_36, Z=num_output_lengths_2)
geo_5 = Geometry(cluster_6)
wbfacepolys_5 = WeaverbirdsFacePolylines(Mesh=geo_5)  # -> flatten(Polygons)
preview_10 = CustomPreview(Geometry=geo_5, Material=ColourSwatch(SwatchColor=RGB(93, 168, 19)))
previewlw_2 = CustomPreviewLineweights(Geometry=wbfacepolys_5, Shader=ColourSwatch(SwatchColor=RGB(10, 0, 0)), Absolute=False)

# ---- group: Wood
mtl_name_7 = VRayMaterialFromProject(
    Has_Extract_Parameter=True,
    Has_Manage_Collection=False,
    OptionsLength=8,
    Options=["/Aluminum_Polished", "/Glass_Window_Neutral", "/Laminate_B01_120cm", "/Laminate_C01_120cm", "/Laminate_C02_120cm", "/Plywood_A_50cm", "/Plywood_B_50cm", "/Plywood_C_50cm"])
part_2_2 = RemoteReceiver(part_2)
vgeo_7 = VRayGeometry(Geo=part_2_2, Material=mtl_name_7)

mtl_name_8 = VRayMaterialFromProject(
    Has_Extract_Parameter=True,
    Has_Manage_Collection=False,
    OptionsLength=8,
    Options=["/Aluminum_Polished", "/Glass_Window_Neutral", "/Laminate_B01_120cm", "/Laminate_C01_120cm", "/Laminate_C02_120cm", "/Plywood_A_50cm", "/Plywood_B_50cm", "/Plywood_C_50cm"])
part_3_2 = RemoteReceiver(part_3)
vgeo_8 = VRayGeometry(Geo=part_3_2, Material=mtl_name_8)

mtl_name_9 = VRayMaterialFromProject(
    Has_Extract_Parameter=True,
    Has_Manage_Collection=False,
    OptionsLength=8,
    Options=["/Aluminum_Polished", "/Glass_Window_Neutral", "/Laminate_B01_120cm", "/Laminate_C01_120cm", "/Laminate_C02_120cm", "/Plywood_A_50cm", "/Plywood_B_50cm", "/Plywood_C_50cm"])
part_1_2 = RemoteReceiver(part_1)
vgeo_9 = VRayGeometry(Geo=part_1_2, Material=mtl_name_9)

# ----
panel_41 = Panel("""900
506""")
panel_42 = Panel("""2600
1462""")
save_file = OutputImage(
    "D:\Roberto\01 Projects\02 IAAC\02 Curso\Studio III\Week 8\3.exr",
    File_Picker=1,
    File_Types="Portable Network Graphics (*.png)|*.png|Windows bitmap (*.bmp)|*.bmp|Targa Image (*.tga)|*.tga|Radiance High-Dynamyc Range (*.hdr)|*.hdr|Silicon Graphics (*.sgi; *.rgb; *.rgba)|*.dgi;*.rgb;*.rgba|JPEG image (*.jpg; *.jpeg)|*.jpg;*.jpeg|OpenEXR image (*.exr)|*.exr|SoftImage PICT (*.pic)|*.pic|Tagged image (*.tif; *.tiff)|*.tif;*.tiff|V-Ray Raw Image (*.vrimg)|*.vrimg",
    Has_Extract_Parameter=False,
    Has_Manage_Collection=True,
    Has_Multiple_Files_Menu=False,
    Has_Picker_File_Menu=False,
    Multiple_Files=False)
sampler = Sampler(0, Has_Extract_Parameter=False, Has_Manage_Collection=False, OptionsLength=2, Options=["Progressive", "Bucket"])
quality = Quality(
    3,
    Has_Extract_Parameter=False,
    Has_Manage_Collection=False,
    OptionsLength=5,
    Options=["Draft", "Low", "Medium", "High", "Very High"])
engine = Engine(0, Has_Extract_Parameter=False, Has_Manage_Collection=False, OptionsLength=2, Options=["CPU", "GPU"])
mode = Mode(0, Has_Extract_Parameter=False, Has_Manage_Collection=False, OptionsLength=2, Options=["Interactive", "Production"])
render = VRayRender(
    Engine=engine,
    Mode=mode,
    Sampler=sampler,
    Quality=quality,
    OutputImage=save_file,
    OutputResolution=panel_42,
    Camera=camera.Camera,
    LightRig=rig_dome,
    VGeometry=flatten([inf_plane, vgeo_4, vgeo_3, vgeo_6, vgeo_2, vgeo_9, vgeo_7, vgeo_8, vgeo, vgeo_5]),
    RenderElements=lighting_analysis)

found_item_2 = RemoteReceiver(found_item)

equals = Equality(FirstNumber=found_item_2, SecondNumber="-1")  # -> Equality, Inequality
cull_3 = CullPattern(List=found_item_2, CullPattern=equals.Inequality)

replace = ReplaceItems(List=rgb, Item=flatten(ColourSwatch(SwatchColor=RGB(120, 180, 30))), Indices=cull_3, Wrap=False)
# Building Shape
preview_11 = CustomPreview(Geometry=move_9.Geometry, Material=replace)

item_37 = ListItem(List=move_9.Geometry, Index=cull_3, Wrap=True)
center_11 = Center(Geometry=item_37)  # -> Center, Dimension
ln_17 = Line(StartPoint=center_10.Center, EndPoint=center_11.Center)
reduce = RandomReduce(List=ln_17, Reduction=Slider(3500, range=0..10000), Seed=1)
dash_3 = DashPattern(Curve=reduce, Pattern=Slider(0.1, range=0..0.1))  # -> Dashes, Gaps
previewlw_3 = CustomPreviewLineweights(Geometry=dash_3.Dashes, Shader=ColourSwatch(SwatchColor=RGB(194, 194, 194)), Absolute=False)

# ==== cluster Cluster
E = ClusterInput()
boundary = BoundarySurfaces(Edges=E)
edges = BrepEdges(Brep=boundary)  # -> Naked, Interior, NonManifold
B = ClusterInput()
A = ClusterInput()
F = ClusterInput()
rdiff = RegionDifference(CurvesA=edges.Naked, CurvesB=B)
rdiff_2 = RegionDifference(CurvesA=A, CurvesB=edges.Naked)
Z = UnitZ(Factor=F)
Z_2 = UnitZ(Factor=Slider(0.05, range=0..10))
extr = Extrude(Base=rdiff_2, Direction=Z_2)
move = Move(Geometry=extr, Motion=Z)  # -> Geometry, Transform
extr_2 = Extrude(Base=rdiff, Direction=Z_2)
move_2 = Move(Geometry=extr_2, Motion=Z)  # -> Geometry, Transform
sdiff = SolidDifference(BrepsA=move_2.Geometry, BrepsB=boundary)
sdiff_2 = SolidDifference(BrepsA=move.Geometry, BrepsB=sdiff)
debrep = DeconstructBrep(Brep=sdiff_2)  # -> Faces, Edges, Vertices
item = ListItem(List=debrep.Faces, Index=Slider(2, range=0..10), Wrap=True)
i = ClusterOutput(item)

# ==== cluster MeshToQuadFaces
M = ClusterInput()
wbnaked = WeaverbirdsNakedBoundary(MeshClosedPolylines=M)
explode = Explode(Curve=wbnaked, Recursive=True)  # -> Segments, Vertices
cull_i = CullIndex(List=explode.Vertices, Indices=-1, Wrap=True)
flip = FlipMatrix(Data=cull_i)
bang = ExplodeTree(Data=flip)  # -> Branch0, Branch1, Branch2, Branch3
srf4pt = _4PointSurface(CornerA=bang.Branch0, CornerB=bang.Branch1, CornerC=bang.Branch2, CornerD=bang.Branch3)
number_slider = Slider(1, range=0..1)
mesh_uv = MeshSurface(Surface=srf4pt, UCount=number_slider, VCount=number_slider, Overhang=True, Equalize=False)
M_2 = ClusterOutput(mesh_uv)

# ==== cluster Cluster_2
C = ClusterInput()
explode = Explode(Curve=C, Recursive=True)  # -> Segments, Vertices
cull_i = CullIndex(List=explode.Vertices, Indices=-1, Wrap=True)
flip = FlipMatrix(Data=cull_i)
bang = ExplodeTree(Data=flip)  # -> Branch0, Branch1, Branch2, Branch3
srf4pt = _4PointSurface(CornerA=bang.Branch0, CornerB=bang.Branch1, CornerC=bang.Branch2, CornerD=bang.Branch3)
number_slider = Slider(1, range=0..1)
mesh_uv = MeshSurface(Surface=srf4pt, UCount=number_slider, VCount=number_slider, Overhang=True, Equalize=False)
M = ClusterOutput(mesh_uv)

# ==== cluster Cluster_3
M = ClusterInput()
center = Center(Geometry=M)  # -> Center, Dimension
facen = FaceNormals(Mesh=M)  # -> Centers, flatten(Normals)
avr = Average(Input=center.Center)
msphere = MeshSphere(Base=avr, Radius=Slider(33, range=0..100), UCount=Slider(50, range=0..100), VCount=Slider(10, range=0..10))
center_2 = Center(Geometry=msphere)  # -> Center, Dimension
vec2pt = Vector2Pt(PointA=flatten(center_2.Center), PointB=flatten(facen.Centers), Unitize=invert(False))  # -> Vector, Length
vdisex = VectorDisplayEx(Point=flatten(facen.Centers), Vector=vec2pt.Vector, Colour=RGB(0, 0, 0), Width=2)
angle = Angle(VectorA=facen.Normals, VectorB=vec2pt.Vector)  # -> Angle, Reflex
smaller = SmallerThan(FirstNumber=angle.Angle, SecondNumber=Slider(1.544, range=-3..3))  # -> SmallerThan, OrEqualTo
dispatch = Dispatch(List=facen.Normals, DispatchPattern=smaller.SmallerThan)  # -> ListA, ListB
mindex = MemberIndex(Set=facen.Normals, Member=dispatch.ListB)  # -> flatten(Index), Count
L = ClusterInput()
item = ListItem(List=L, Index=mindex.Index, Wrap=True)
flipm = FlipMesh(Mesh=item, VertexNormals=True, FaceNormals=True, FaceOrientation=True)
L_2 = ClusterInput()
replace = ReplaceItems(List=L_2, Item=flipm, Indices=mindex.Index, Wrap=False)
L_3 = ClusterOutput(replace)
dirdisplay = NormalDisplay(Geometry=replace, FrontFaceColor=RGB(0, 187, 255), BackFaceColor=RGB(255, 0, 0))

# ==== cluster Cluster_4
T = ClusterInput()
tstat = TreeStatistics(Tree=T)  # -> flatten(Paths), Length, Count
lng = ListLength(List=tstat.Paths)
series = Series(Start=0, Step=1, Count=lng)
T_2 = ClusterInput()
tstat_2 = TreeStatistics(Tree=T_2)  # -> Paths, Length, Count
item = ListItem(List=tstat_2.Paths, Index=series, Wrap=True)
T_3 = ClusterInput()
branch = TreeBranch(Tree=T_3, Path=item, MaintainPaths=True)
B = ClusterOutput(branch)

# ==== cluster Cluster_5
M = ClusterInput()
B = ClusterInput()
X = ClusterInput()
Y = ClusterInput()
Z = ClusterInput()
explode = MeshExplode(Mesh=M, Interpolate=False)
unifynormals = MeshUnifyNormals(Mesh=explode)
box = DomainBox(Base=B, X=X, Y=Y, Z=Z)
item = ListItem(List=unifynormals, Index=0, Wrap=True)  # -> flatten(Item)
G = ClusterInput()
facen = FaceNormals(Mesh=item)  # -> Centers, flatten(Normals)
center = Center(Geometry=G)  # -> Center, Dimension
pl = PlaneNormal(Origin=center.Center, ZAxis=facen.Normals)

item_2 = ListItem(List=unifynormals, Index=Slider(15, range=0..15), Wrap=True)  # -> flatten(Item)
item_3 = ListItem(List=unifynormals, Index=Slider(12, range=0..15), Wrap=True)  # -> flatten(Item)
center_2 = Center(Geometry=item_3)  # -> Center, Dimension
center_3 = Center(Geometry=item_2)  # -> Center, Dimension
project = Project(Geometry=center_2.Center, Plane=pl)  # -> Geometry, Transform
project_2 = Project(Geometry=center_3.Center, Plane=pl)  # -> Geometry, Transform
ln = Line(StartPoint=project.Geometry, EndPoint=project_2.Geometry)
vec2pt = Vector2Pt(PointA=project.Geometry, PointB=project_2.Geometry, Unitize=False)  # -> flatten(Vector), Length

center_4 = Center(Geometry=box)  # -> Center, Dimension
xz = XZPlane(Origin=center_4.Center)
orient = OrientDirection(Geometry=box, PointA=center_4.Center, DirectionA=xz, PointB=center.Center, DirectionB=facen.Normals)  # -> Geometry, Transform

debrep = DeconstructBrep(Brep=orient.Geometry)  # -> Faces, Edges, Vertices
item_4 = ListItem(List=debrep.Faces, Index=4, Wrap=True)
item_5 = ListItem(List=debrep.Faces, Index=5, Wrap=True)
center_5 = Center(Geometry=item_4)  # -> flatten(Center), Dimension
center_6 = Center(Geometry=item_5)  # -> flatten(Center), Dimension
project_3 = Project(Geometry=center_5.Center, Plane=pl)  # -> Geometry, Transform
project_4 = Project(Geometry=center_6.Center, Plane=pl)  # -> Geometry, Transform
ln_2 = Line(StartPoint=project_3.Geometry, EndPoint=project_4.Geometry)
vec2pt_2 = Vector2Pt(PointA=project_3.Geometry, PointB=project_4.Geometry, Unitize=False)  # -> flatten(Vector), Length

angle = Angle(VectorA=vec2pt.Vector, VectorB=vec2pt_2.Vector, Plane=pl)  # -> Angle, Reflex; disabled
f_vangsign = VectorAngleWithSign(V1=vec2pt.Vector, V2=vec2pt_2.Vector, Z=pl)  # -> A; inputs V1: Vector3d, V2: Vector3d, Z: Vector3d
# ---------- f_vangsign: C# ----------
       /*
    froGH - a sparse collection of (in)utilities for Grasshopper

    Vector angle with Sign v 0.1
    code by Alessio Erioli

    froGH by Co-de-iT is licensed under a Creative Commons Attribution 4.0 International License.
    http://creativecommons.org/licenses/by/4.0/

    */
    initComp();
    // maps vector coordinates to the plane space
    if (Z.IsZero) Z = Vector3d.ZAxis;
    Plane p = new Plane(new Point3d(0, 0, 0), V1, Z);
    p.Rotate(-Math.PI * 0.5, V1);
    Point3d p1,p2;
    p.RemapToPlaneSpace((Point3d) V1, out p1);
    p.RemapToPlaneSpace((Point3d) V2, out p2);

    A = angSign((Vector3d) p1, (Vector3d) p2);
# ---------- f_vangsign: C# additional code ----------
  void initComp(){
    Component.Name = "Vector Angle with sign";
    Component.NickName = "f_VAngSign";
    Component.Description = "Computes angle between vectors with direction-dependent sign:\nclockwise is -, counter-clockwise is +";
    Component.Params.Input[0].Name = "Vector 1";
    Component.Params.Input[0].Description = "first vector";
    Component.Params.Input[1].Name = "Vector 2";
    Component.Params.Input[1].Description = "second vector";
    Component.Params.Input[2].Name = "Z axis";
    Component.Params.Input[2].Description = "Z axis of reference plane - keep empty for World Z";
    Component.Params.Output[0].Name = "Angle";
    Component.Params.Output[0].Description = "Angle (with sign) between vectors";
  }

  double angSign(Vector3d v1, Vector3d v2){
    v1.Unitize();
    v2.Unitize();
    return (System.Math.Atan2(v2.Y, v2.X) - System.Math.Atan2(v1.Y, v1.X));
  }
# ---------- end f_vangsign ----------
neg = Negative(Value=f_vangsign)
prot = RotatePlane(Plane=pl, Angle=neg)
orient_2 = Orient(Geometry=box, Source=xz, Target=prot)  # -> Geometry, Transform

debrep_2 = DeconstructBrep(Brep=orient_2.Geometry)  # -> Faces, Edges, Vertices
item_6 = ListItem(List=debrep_2.Faces, Index=4, Wrap=True)
item_7 = ListItem(List=debrep_2.Faces, Index=5, Wrap=True)
center_7 = Center(Geometry=item_6)  # -> flatten(Center), Dimension
center_8 = Center(Geometry=item_7)  # -> flatten(Center), Dimension
project_5 = Project(Geometry=center_7.Center, Plane=prot)  # -> Geometry, Transform
project_6 = Project(Geometry=center_8.Center, Plane=prot)  # -> Geometry, Transform
ln_3 = Line(StartPoint=project_5.Geometry, EndPoint=project_6.Geometry)
vec2pt_3 = Vector2Pt(PointA=project_5.Geometry, PointB=project_6.Geometry, Unitize=False)  # -> flatten(Vector), Length

project_7 = Project(Geometry=center_2.Center, Plane=prot)  # -> Geometry, Transform
project_8 = Project(Geometry=center_3.Center, Plane=prot)  # -> Geometry, Transform
ln_4 = Line(StartPoint=project_7.Geometry, EndPoint=project_8.Geometry)
vec2pt_4 = Vector2Pt(PointA=project_7.Geometry, PointB=project_8.Geometry, Unitize=False)  # -> flatten(Vector), Length
f_vangsign_2 = VectorAngleWithSign(V1=vec2pt_4.Vector, V2=vec2pt_3.Vector, Z=prot)  # -> A; inputs V1: Vector3d, V2: Vector3d, Z: Vector3d; same code as f_vangsign
neg_2 = Negative(Value=f_vangsign_2)
rotate = Rotate(Geometry=orient_2.Geometry, Angle=neg_2, Plane=prot)  # -> Geometry, Transform
G_2 = ClusterOutput(rotate.Geometry)

# ==== cluster ClusterJoinCurves
crv = ClusterInput()

# ---- group: Join curves that follow the same angles
crv_2 = Curve(flatten(crv))
end = EndPoints(Curve=crv_2)  # -> Start, End
vec2pt = Vector2Pt(PointA=end.Start, PointB=end.End, Unitize="1")  # -> Vector, Length
multiplication = Multiplication(A=vec2pt.Vector, B="10")
devec = DeconstructVector(Vector=multiplication)  # -> XComponent, YComponent, ZComponent
int = Integer(devec.XComponent)
int_2 = Integer(devec.YComponent)
int_3 = Integer(devec.ZComponent)
vec = VectorXYZ(XComponent=int, YComponent=int_2, ZComponent=int_3)  # -> Vector, Length
python = GhPythonScript(vectors=vec.Vector)  # -> out, output; inputs vectors: list
# ---------- python: Python ----------
__author__ = "matt"
__version__ = "2020.06.18"

import rhinoscriptsyntax as rs
import ghpythonlib.components as gh

output = []



for v in vectors:
    
    parts = gh.DeconstructVector(v)
    
    parts = [0 if n ==0 else (n / abs(n)) for n in parts]
    
    part_sum = sum(parts)
    
    if parts[2] != 0:
        if parts[2] == -1:
            output.append(gh.Reverse(v))
        else:
            output.append(v)
    elif parts[1] != 0:
        if parts[1] == -1:
            output.append(gh.Reverse(v))
        else:
            output.append(v)
            
    elif parts[0] != 0:
        if parts[0] == -1:
            output.append(gh.Reverse(v))
        else:
            output.append(v)
# ---------- end python ----------
cset = CreateSet(List=python.output)  # -> Set, Map
mindex = MemberIndex(Set=python.output, Member=cset.Set)  # -> Index, Count
item = ListItem(List=crv_2, Index=mindex.Index, Wrap=True)
vdis = VectorDisplay(Anchor="0,0,0", Vector=cset.Set)

# ----
dupln = RemoveDuplicateLines(Lines=item, Tolerance=0.01)

# ---- group: Join curves that follow the same angles (continued)
join = JoinCurves(Curves=simplify(dupln), Preserve=False)
crv_3 = Curve(reparameterize(flatten(join)))

# ---- group: Callout and Preview Individual Orientations
crv_4 = Curve(join)  # disabled
number_slider = Slider(0, range=0..8)  # disabled
simplify = SimplifyCurve(Curve=crv_4)  # -> Curve, Simplified; disabled
panel = Panel("9")  # disabled
panel_2 = Panel("1")  # disabled
division = Division(A=number_slider, B=panel)  # disabled
tstat = TreeStatistics(Tree=simplify.Curve)  # -> Paths, Length, Count; disabled
addition = Addition(A=tstat.Count, B=panel_2)  # disabled
branch = TreeBranch(Tree=simplify(simplify.Curve), Path=number_slider, MaintainPaths=True)  # disabled
range = Range(Domain=Domain(0, 1), Steps=tstat.Count)  # disabled
panel_3 = Panel("-1")  # disabled
panel_4 = Panel("0.1")  # disabled
panel_5 = Panel("1")  # disabled
split = SplitList(List=range, Index=tstat.Count)  # -> ListA, ListB; disabled
mpipe = MeshPipe(Polylines=branch, NumberOfSides=4, Tolerance=0.1, Radius=panel_4, Cap=False, Join=False)  # disabled
hsv = ColourHSV(Alpha=panel_5, Hue=division, Saturation=panel_5, Value=panel_5)  # disabled
preview = CustomPreview(Geometry=simplify(mpipe), Material=simplify(graft(hsv)))  # disabled

# ----
crv_5 = ClusterOutput(crv_3)
